# Grasshopper definition 03c_simple_nat_vent_human_lod0_boundingbox.gh (Grasshopper 1.0.8)

# ----
# 1. Build a simple room with natural ventilation through an opened window & a bounding box
number_slider = Slider(2.5, range=0..3)
number_slider_2 = Slider(3500, range=0..5000)
number_slider_3 = Slider(3000, range=0..5000)
multiplication = Multiplication(A=number_slider_2, B=Slider(2, range=0..2))
multiplication_2 = Multiplication(A=number_slider_2, B=Slider(1, range=0..2))
multiplication_3 = Multiplication(A=number_slider_2, B=Slider(2, range=0..2))
multiplication_4 = Multiplication(A=number_slider_2, B=Slider(1, range=0..2))
multiplication_5 = Multiplication(A=number_slider_2, B=Slider(0.5, range=0..2))
multiplication_6 = Multiplication(A=number_slider_2, B=Slider(0.5, range=0..2))
multiplication_7 = Multiplication(A=number_slider_2, B=Slider(0.5, range=0..2))
multiplication_8 = Multiplication(A=number_slider_2, B=Slider(0.5, range=0..2))
multiplication_9 = Multiplication(A=number_slider_3, B=number_slider)
neg = Negative(Value=multiplication)
neg_2 = Negative(Value=multiplication_3)
neg_3 = Negative(Value=multiplication_6)
neg_4 = Negative(Value=multiplication_5)
pt = ConstructPoint(XCoordinate=0, YCoordinate=0, ZCoordinate=0)
pt_2 = ConstructPoint(XCoordinate=number_slider_2, YCoordinate=0, ZCoordinate=0)
pt_3 = ConstructPoint(XCoordinate=0, YCoordinate=number_slider_2, ZCoordinate=0)
pt_4 = ConstructPoint(XCoordinate=number_slider_2, YCoordinate=number_slider_2, ZCoordinate=0)
Y = UnitY(Factor=neg)
Y_2 = UnitY(Factor=multiplication_2)
Z = UnitZ(Factor=number_slider_3)
X = UnitX(Factor=neg_4)
Y_3 = UnitY(Factor=neg_2)
X_2 = UnitX(Factor=neg_3)
Y_4 = UnitY(Factor=multiplication_4)
X_3 = UnitX(Factor=multiplication_7)
X_4 = UnitX(Factor=multiplication_8)
srf4pt = _4PointSurface(CornerA=pt, CornerB=pt_2, CornerC=pt_4, CornerD=pt_3)
Z_2 = UnitZ(Factor=Slider(1100, range=0..2000))
Z_3 = UnitZ(Factor=multiplication_9)
move = Move(Geometry=pt, Motion=Y)  # -> Geometry, Transform
move_2 = Move(Geometry=pt_3, Motion=Y_2)  # -> Geometry, Transform
X_5 = UnitX(Factor=Slider(1200, range=0..2000))
move_3 = Move(Geometry=pt_2, Motion=Y_3)  # -> Geometry, Transform
move_4 = Move(Geometry=pt_4, Motion=Y_4)  # -> Geometry, Transform
move_5 = Move(Geometry=move.Geometry, Motion=X)  # -> Geometry, Transform
move_6 = Move(Geometry=move_2.Geometry, Motion=X_2)  # -> Geometry, Transform
move_7 = Move(Geometry=move_3.Geometry, Motion=X_3)  # -> Geometry, Transform
move_8 = Move(Geometry=move_4.Geometry, Motion=X_4)  # -> Geometry, Transform
extr = Extrude(Base=srf4pt, Direction=Z)
debrep = DeconstructBrep(Brep=extr)  # -> Faces, Edges, Vertices
srf4pt_2 = _4PointSurface(CornerA=move_5.Geometry, CornerB=move_7.Geometry, CornerC=move_8.Geometry, CornerD=move_6.Geometry)
extr_2 = Extrude(Base=srf4pt_2, Direction=Z_3)
debrep_2 = DeconstructBrep(Brep=extr_2)  # -> Faces, Edges, Vertices
item = ListItem(List=debrep.Faces, Index=Slider(1, range=1..7), Wrap=True)
item_2 = ListItem(List=debrep.Faces, Index=Slider(2, range=1..7), Wrap=True)
item_3 = ListItem(List=debrep.Faces, Index=Slider(3, range=1..7), Wrap=True)
item_4 = ListItem(List=debrep.Faces, Index=Slider(4, range=1..7), Wrap=True)
item_5 = ListItem(List=debrep.Faces, Index=Slider(5, range=1..7), Wrap=True)
item_6 = ListItem(List=debrep.Faces, Index=Slider(6, range=1..7), Wrap=True)
xz = XZPlane(Origin=Point(0, 0, 0))
scale_nu = ScaleNU(Geometry=item, Plane=xz, ScaleX=0.4, ScaleY=0.4, ScaleZ=1)  # -> Geometry, Transform
item_7 = ListItem(List=debrep_2.Faces, Index=Slider(1, range=1..7), Wrap=True)
item_8 = ListItem(List=debrep_2.Faces, Index=Slider(2, range=1..7), Wrap=True)
item_9 = ListItem(List=debrep_2.Faces, Index=Slider(3, range=1..7), Wrap=True)
item_10 = ListItem(List=debrep_2.Faces, Index=Slider(4, range=1..7), Wrap=True)
item_11 = ListItem(List=debrep_2.Faces, Index=Slider(5, range=1..7), Wrap=True)
item_12 = ListItem(List=debrep_2.Faces, Index=Slider(6, range=1..7), Wrap=True)
move_9 = Move(Geometry=scale_nu.Geometry, Motion=Z_2)  # -> Geometry, Transform
move_10 = Move(Geometry=move_9.Geometry, Motion=X_5)  # -> Geometry, Transform
sdiff = SolidDifference(BrepsA=item, BrepsB=move_10.Geometry)
debrep_3 = DeconstructBrep(Brep=move_10.Geometry)  # -> Faces, Edges, Vertices
merge = Merge(Data1=item_8, Data2=item_10, Data3=item_11, Data4=item_12)
item_13 = ListItem(List=debrep_3.Edges, Index=1, Wrap=True)
pi = Pi(Factor=Slider(-0.2, range=-1..1))
rotax = RotateAxis(Geometry=move_10.Geometry, Angle=pi, Axis=item_13)  # -> Geometry, Transform
preview = CustomPreview(Geometry=item_9, Material=ColourSwatch(SwatchColor=RGB(255, 153, 0)))
preview_2 = CustomPreview(Geometry=item_7, Material=ColourSwatch(SwatchColor=RGBA(51, 255, 0, 124)))
preview_3 = CustomPreview(Geometry=merge, Material=ColourSwatch(SwatchColor=RGBA(255, 255, 255, 124)))
preview_4 = CustomPreview(Geometry=[item_2, item_3, item_4, item_6, item_5], Material=ColourSwatch(SwatchColor=RGBA(255, 255, 255, 105)))
preview_5 = CustomPreview(Geometry=sdiff, Material=ColourSwatch(SwatchColor=RGBA(0, 178, 255, 105)))
preview_6 = CustomPreview(Geometry=rotax.Geometry, Material=ColourSwatch(SwatchColor=RGB(166, 0, 255)))

# ----
# Tune the manikin to match the calculated BSA
number_slider_4 = Slider(0.5, range=0..2)
pi_2 = Pi(Factor=number_slider_4)
pt_5 = ConstructPoint(XCoordinate=Slider(2000, range=0..5000), YCoordinate=Slider(2200, range=0..5000), ZCoordinate=0)
manikin_lod_0 = ManikinLOD0(
    base_point=pt_5,
    unit="mm",
    width=Slider(340, range=0..5000),
    height=Slider(1080, range=0..5000),
    stv_height=Slider(170, range=0..500),
    activity="light",
    breathing_flow_rate="7.2",
    mouth_scaling=Slider(4, range=1..5),
    angle=pi_2)  # -> body_surface_area_2, body_2, mouth_2, breathing_u
bsa_in_m2 = Panel(manikin_lod_0.body_surface_area_2)
breathing_velocity_in_m_s = Panel(manikin_lod_0.breathing_u)
preview_7 = CustomPreview(Geometry=manikin_lod_0.body_2, Material=ColourSwatch(SwatchColor=RGBA(0, 0, 0, 150)))
preview_8 = CustomPreview(Geometry=manikin_lod_0.mouth_2, Material=ColourSwatch(SwatchColor=RGBA(255, 0, 0, 150)))

# ----
# Get BSA using Du Bois' Formula
panel = Panel("60")
bsa_du_bois = BSADuBois(height="170", weight=panel)  # -> BSA; inputs height: Double, weight: Double
#   port BSA: Body Surface Area in m2
# ---------- bsa_du_bois: Python ----------
height = 0.0 if height is None or height <= 0 else height
weight = 0.0 if weight is None or weight <= 0 else weight

# BSA (m^2) / height (cm) /  weight (kg)
BSA = 0.007184 * (height ** 0.725) * (weight ** 0.425)
# ---------- end bsa_du_bois ----------
bsa_in_m2_2 = Panel(bsa_du_bois)

# ----
# 2. Define the boundary conditions for all surfaces, e.g. Wall / Inlet / Outlet / Human body
# ~ 46000 ppm
# (7.2 L/min resipiration
# & 0.0055 L/s CO2)
number_slider_5 = Slider(295.15, range=273.15..300)
pcen = PolygonCenter(Polyline=manikin_lod_0.mouth_2)  # -> CenterV, CenterE, CenterA
pcen_2 = PolygonCenter(Polyline=item_7)  # -> CenterV, CenterE, CenterA
neg_5 = Negative(Value=manikin_lod_0.breathing_u)
vec = VectorXYZ(XComponent=0, YComponent=neg_5, ZComponent=0)  # -> Vector, Length
vdis = VectorDisplay(Anchor=pcen.CenterV, Vector=vec.Vector)
vec_2 = VectorXYZ(XComponent=0, YComponent=Slider(0.1, range=-2..2), ZComponent=0)  # -> Vector, Length
vdis_2 = VectorDisplay(Anchor=pcen_2.CenterV, Vector=vec_2.Vector)
body = CarbonflyBody(temperature=Slider(307.85, range=273.15..310))  # -> boundary; inputs temperature: Double
#   port temperature: Skin temperature in K
#   port boundary: Body boundary
# ---------- body: Python ----------
# GH inputs:
#   temperature (Number)  # K
# GH outputs:
#   boundary

from math import isfinite
import carbonfly.boundary as cfbc

try:
    # check T input
    T = float(temperature)
    if not isfinite(T):
        raise ValueError("Temperature (T) must be a finite number (K).")

    fields = {
        "U":        cfbc.FieldNoSlip(),
        "T":        cfbc.FieldFV(T),
        "CO2":      cfbc.FieldZG(),
        "p":        cfbc.FieldZG(),
        "p_rgh":    cfbc.FieldFixedFluxPressure("$internalField"),
        "alphat":   cfbc.FieldAlphatJayatillekeWF(value="$internalField", Prt=0.85),
        "epsilon":  cfbc.FieldEpsilonWallFunction("$internalField"),
        "G":        cfbc.FieldMarshakRadiation(emissivity=0.98, value="$internalField"),
        "k":        cfbc.FieldKqRWallFunction("$internalField"),
        "nut":      cfbc.FieldNutkWallFunction("$internalField"),
        "Ydefault": cfbc.FieldFV("$internalField"),
    }

    boundary = cfbc.Boundary(
        region_name="",
        btype="wall",
        fields=fields
    )

except Exception as e:
    boundary = None
# ---------- end body ----------
wall = CarbonflyWall(temperature=number_slider_5)  # -> boundary; inputs temperature: Double; same code as body
panel_2 = Panel(wall)
panel_3 = Panel(body)
wall_2 = CarbonflyWall(temperature=Slider(295.15, range=273.15..300))  # -> boundary; inputs temperature: Double; same code as body
panel_4 = Panel(wall_2)
wall_3 = CarbonflyWall(temperature=Slider(285.15, range=273.15..300))  # -> boundary; inputs temperature: Double; same code as body
panel_5 = Panel(wall_3)
inletvelocity = CarbonflyInletVelocity(velocity=vec.Vector, temperature=Slider(309.15, range=273.15..315), CO2=Slider(0.046, range=0.0004..0.05))  # -> boundary; inputs velocity: Vector3d, temperature: Double, CO2: Double
#   port velocity: Inlet velocity (m/s) as a vector, e.g. (0, 0, -1).
#   port temperature: Inlet temperature in K (e.g. 293.15).
#   port CO2: Inlet CO₂ as volume fraction (e.g., 0.000450 for 450 ppm).
#   port boundary: InletVelocity boundary
# ---------- inletvelocity: Python ----------
# GH inputs: velocity (Rhino.Geometry.Vector3d), temperature (float), CO2 (float)
# GH outputs: boundary
from math import isfinite
import carbonfly.boundary as cfbc

def vec3_to_tuple(v):
    return (float(v.X), float(v.Y), float(v.Z))

try:
    # check input
    if velocity is None:
        raise ValueError("velocity is required.")
    if not isfinite(temperature):
        raise ValueError("Temperature (T) must be a finite number.")
    if not isfinite(CO2):
        raise ValueError("CO2 must be a finite number (fraction).")

    fields = {
        "U":        cfbc.FieldFV(vec3_to_tuple(velocity)),
        "T":        cfbc.FieldFV(float(temperature)),
        "CO2":      cfbc.FieldFV(float(CO2)),
        "air":      cfbc.FieldFV(1-float(CO2)),
        "p":        cfbc.FieldFV("$internalField"),
        "p_rgh":    cfbc.FieldFixedFluxPressure("$internalField"),
        "alphat":   cfbc.FieldCalculated("$internalField"),
        "epsilon":  cfbc.FieldMixingLengthEpsilonInlet(value="$internalField", mixingLength=0.0168),
        "G":        cfbc.FieldMarshakRadiation(emissivity=0.98, value="$internalField"),
        "k":        cfbc.FieldIntensityKInlet(intensity=0.14, value="$internalField"),
        "nut":      cfbc.FieldCalculated("$internalField"),
        "Ydefault": cfbc.FieldFV("$internalField"),
    }

    boundary = cfbc.Boundary(
        region_name="",
        btype="inletVelocity",
        fields=fields
    )

except Exception as e:
    boundary = None
# ---------- end inletvelocity ----------
panel_6 = Panel(inletvelocity)
inletvelocity_2 = CarbonflyInletVelocity(velocity=vec_2.Vector, temperature=Slider(285.15, range=273.15..300), CO2=Slider(0.0004, range=0.0004..0.001))  # -> boundary; inputs velocity: Vector3d, temperature: Double, CO2: Double; same code as inletvelocity
panel_7 = Panel(inletvelocity_2)
outlet = CarbonflyOutlet()  # -> boundary
#   port boundary: Outlet boundary
# ---------- outlet: Python ----------
# GH outputs:
#   boundary

import carbonfly.boundary as cfbc

try:
    fields = {
        "U":        cfbc.FieldZG(),
        "T":        cfbc.FieldZG(),
        "CO2":      cfbc.FieldZG(),
        "p":        cfbc.FieldZG(),
        "p_rgh":    cfbc.FieldFV("$internalField"),
        "alphat":   cfbc.FieldZG(),
        "epsilon":  cfbc.FieldZG(),
        "G":        cfbc.FieldZG(),
        "k":        cfbc.FieldZG(),
        "nut":      cfbc.FieldZG(),
        "Ydefault": cfbc.FieldFV("$internalField"),
    }

    boundary = cfbc.Boundary(
        region_name="",
        btype="zeroGradientOutlet",
        fields=fields
    )
except Exception as e:
    boundary = None
# ---------- end outlet ----------
panel_8 = Panel(outlet)
createcfgeometry = CreateCarbonflyGeometry(name="body", geometry=flatten(manikin_lod_0.body_2), boundary=body, refine_levels="(4,6)")  # -> log, CF_geo; inputs name: String, geometry: list of GeometryBase, boundary: list, refine_levels: Interval
#   port name: Region/solid name for STL & regions{}.
#   port geometry: Single surface/face/brep or a collection
#   port boundary: Carbonfly boundary
#   port refine_levels: Refine levels for meshing: (min, max) or as a single float number
#   port CF_geo: Carbonfly Geometry
# ---------- createcfgeometry: Python ----------
# GH inputs:
#   name (str), 
#   geometry (list + flatten), 
#   boundary (carbonfly boundary or list), 
#   refine_levels (interval or list)
# GH outputs:
#   CF_geo, log

import carbonfly.geo as cfgeo

def as_list(x):
    return x if isinstance(x, (list, tuple)) else [x]

def broadcast_to_len(lst, n, fallback=None):
    """If length==1 -> broadcast to n; if length==0 -> use fallback (then broadcast); else length must equal n."""
    if lst is None:
        lst = [] if fallback is None else [fallback]
    if len(lst) == 0:
        lst = [] if fallback is None else [fallback]
    if len(lst) == 1 and n > 1:
        return lst * n
    return lst

CF_geo = []
logs = []
try:
    geos = as_list(geometry)
    if not geos:
        raise ValueError("Geometry list is empty. Please connect a flattened Surface/BrepFace/Brep list.")

    N = len(geos)

    # name
    if not isinstance(name, str) or not name.strip():
        raise ValueError("Input 'name' must be a single non-empty string.")
    region_name = name.strip()
    names = [region_name] * N   # broadcast the same name to all geometries

    # boundary
    bnds = as_list(boundary) if boundary is not None else []
    bnds = broadcast_to_len(bnds, N, fallback=None)
    if len(bnds) != N:
        raise ValueError(f"The number of boundaries ({len(bnds)}) does not match the number of geometries ({N}) and cannot be broadcast.")

    # refine_levels
    refs = as_list(refine_levels) if refine_levels is not None else []
    refs = broadcast_to_len(refs, N, fallback=None)
    if len(refs) != N:
        raise ValueError(f"The number of refine_levels ({len(refs)}) does not match the number of geometries ({N}) and cannot be broadcast.")

    # build CFGeo items
    for i in range(N):
        cg = cfgeo.make_cfgeo(names[i], geos[i], bnds[i], refs[i])
        CF_geo.append(cg)

    logs.append(f"CF_geo created: {len(CF_geo)} item(s):\n{CF_geo[0].name} -> refine=({CF_geo[0].refine.min_level}, {CF_geo[0].refine.max_level})")
    log = "\n".join(logs)

except Exception as e:
    CF_geo = []
    log = f"[Error] {e}"
# ---------- end createcfgeometry ----------
createcfgeometry_2 = CreateCarbonflyGeometry(name="window", geometry=flatten(rotax.Geometry), boundary=wall, refine_levels="(3,5)")  # -> log, CF_geo; inputs name: String, geometry: list of GeometryBase, boundary: list, refine_levels: Interval; same code as createcfgeometry
createcfgeometry_3 = CreateCarbonflyGeometry(name="mouth", geometry=flatten(manikin_lod_0.mouth_2), boundary=inletvelocity, refine_levels="(5,7)")  # -> log, CF_geo; inputs name: String, geometry: list of GeometryBase, boundary: list, refine_levels: Interval; same code as createcfgeometry
createcfgeometry_4 = CreateCarbonflyGeometry(name="wall", geometry=flatten([item_2, item_3, item_4, sdiff, item_6, item_5]), boundary=wall_2, refine_levels="(1,4)")  # -> log, CF_geo; inputs name: String, geometry: list of GeometryBase, boundary: list, refine_levels: Interval; same code as createcfgeometry
createcfgeometry_5 = CreateCarbonflyGeometry(name="boundingBoxIn", geometry=flatten(item_7), boundary=inletvelocity_2, refine_levels="(0,0)")  # -> log, CF_geo; inputs name: String, geometry: list of GeometryBase, boundary: list, refine_levels: Interval; same code as createcfgeometry
createcfgeometry_6 = CreateCarbonflyGeometry(name="boundingBoxOut", geometry=flatten(item_9), boundary=outlet, refine_levels="(0,0)")  # -> log, CF_geo; inputs name: String, geometry: list of GeometryBase, boundary: list, refine_levels: Interval; same code as createcfgeometry
createcfgeometry_7 = CreateCarbonflyGeometry(name="boundingBox", geometry=flatten(merge), boundary=wall_3, refine_levels="(0,0)")  # -> log, CF_geo; inputs name: String, geometry: list of GeometryBase, boundary: list, refine_levels: Interval; same code as createcfgeometry
panel_9 = Panel(createcfgeometry_2.CF_geo)
panel_10 = Panel(createcfgeometry.CF_geo)
panel_11 = Panel(createcfgeometry_2.log)
panel_12 = Panel(createcfgeometry.log)
panel_13 = Panel(createcfgeometry_4.CF_geo)
panel_14 = Panel(createcfgeometry_7.CF_geo)
panel_15 = Panel(createcfgeometry_4.log)
panel_16 = Panel(createcfgeometry_3.CF_geo)
panel_17 = Panel(createcfgeometry_7.log)
panel_18 = Panel(createcfgeometry_3.log)
panel_19 = Panel(createcfgeometry_5.CF_geo)
panel_20 = Panel(createcfgeometry_6.CF_geo)
panel_21 = Panel(createcfgeometry_5.log)
panel_22 = Panel(createcfgeometry_6.log)

# ----
# 3. Define internalField:
# initial values inside the domain
# (cell values, not boundaries)
panel_23 = Panel("0.001000")
vec_3 = VectorXYZ(XComponent=0, YComponent=0, ZComponent=0)  # -> Vector, Length
internalfields = CarbonflyInternalFields(U_internal=vec_3.Vector, T_internal="300", CO2_internal=panel_23, p_internal="101325")  # -> log, internalFields; inputs U_internal: Vector3d, T_internal: Double, CO2_internal: Double, p_internal: Double
#   port U_internal: internalFields for U
#   port T_internal: internalFields for air temperature
#   port CO2_internal: internalFields for CO₂ concentration, as volume fraction (e.g., 0.000450 for 450 ppm).
#   port p_internal: internalFields for pressure
#   port internalFields: Carbonfly internalFields
# ---------- internalfields: Python ----------
# GH inputs:
#   U_internal (Vector)    # optional, m/s
#   T_internal (Number)    # optional, K
#   CO2_internal (Number)  # optional, volume fraction (e.g. 0.00045)
#   p_internal (Number)    # optional, Pa
# GH outputs:
#   log
#   internalFields

from math import isfinite
import json

def _vec3_or_none(v):
    if v is None:
        return None
    try:
        return (float(v.X), float(v.Y), float(v.Z))
    except Exception:
        raise ValueError("U_internal must be a Rhino Vector (X,Y,Z).")

def _finite_or_none(x, label):
    if x is None:
        return None
    try:
        val = float(x)
    except Exception:
        raise ValueError("{} must be a number.".format(label))
    if not isfinite(val):
        raise ValueError("{} must be finite.".format(label))
    return val

logs = []
try:
    Ui = _vec3_or_none(U_internal)
    Ti = _finite_or_none(T_internal, "T_internal")
    Ci = _finite_or_none(CO2_internal, "CO2_internal")
    Pi = _finite_or_none(p_internal, "p_internal")

    internalFields = {
        "U":        Ui,
        "T":        Ti,
        "CO2":      Ci,
        "p":        Pi,
        "p_rgh":    0,
        "alphat":   0,
        "epsilon":  0.01,
        "G":        0,
        "k":        0.1,
        "nut":      0,
        "Ydefault": 0,
    }
    internalFields = json.dumps(internalFields)

    # Brief log
    logs.append("[internalFields] packaged:")
    logs.append("  U:   {} m/s".format(Ui if Ui is not None else "None"))
    logs.append("  T:   {} K".format(Ti if Ti is not None else "None"))
    logs.append("  CO2: {} ppm".format(Ci*1e6 if Ci is not None else "None"))
    logs.append("  p:   {} hPa".format(Pi/100 if Pi is not None else "None"))
    logs.append("  ...")

    log = "\n".join(logs)

except Exception as e:
    internalFields = None
    log = "[Error] {}".format(e)
# ---------- end internalfields ----------
panel_24 = Panel(internalfields.log)
panel_25 = Panel(internalfields.internalFields)

merge_2 = Merge(
    Data1=createcfgeometry_2.CF_geo,
    Data2=createcfgeometry_4.CF_geo,
    Data3=createcfgeometry_7.CF_geo,
    Data4=createcfgeometry_5.CF_geo,
    Data5=createcfgeometry_6.CF_geo,
    Data6=createcfgeometry.CF_geo,
    Data7=createcfgeometry_3.CF_geo)

# ----
# 4. Here some OpenFOAM settings:
# - mode: Transient or steady-state simulation
# - writeInterval: How often should the results be saved
# - endTime: How long do you want to simulate
# 
# For advanced settings, it is recommended to directly modify
# the settings within the generated case. You may also modify
# the template or provide the path to your own template.
panel_26 = Panel("100")
controldict = CarbonflyControlDict(mode="steady", writeInterval=panel_26, endTime="5000")  # -> log, controlDict; inputs mode: String, writeInterval: Double, endTime: Double
#   port mode: Simulation mode: transient or steady-state
#   port endTime: Simulation end time, in seconds (transient) / iterations (steady-state)
#   port controlDict: Carbonfly controlDict
# ---------- controldict: Python ----------
# GH inputs:
#   mode (Text)      # "steady" or "transient"
#   endTime (Number) # transient: seconds; steady: iterations
# GH outputs:
#   controlDict (Text)
#   log (Text)

import json
import importlib
import carbonfly.control_dict as cfdict
importlib.reload(cfdict)

def _norm_mode(m):
    m = (m or "transient").strip().lower()
    return "steady" if m in ("steady", "steady-state", "steadystate") else "transient"

def _norm_endtime(val, is_transient):
    # transient -> float seconds / steady state -> int interations
    if val is None:
        return 120.0 if is_transient else 1000
    try:
        v = float(val)
    except:
        return 120.0 if is_transient else 1000
    return float(v) if is_transient else max(1, int(round(v)))

logs = []
try:
    mode_norm = _norm_mode(mode)
    is_transient = (mode_norm == "transient")
    et = _norm_endtime(endTime, is_transient)

    if is_transient:
        base = cfdict.make_default("transient", application="buoyantReactingFoam")
        base["endTime"] = float(et)   # seconds
    else:
        base = cfdict.make_default("steady", application="buoyantReactingFoam")
        base["endTime"] = int(et)     # iterations

    if writeInterval is not None:
        base["writeInterval"] = float(writeInterval)

    controlDict = json.dumps(base, ensure_ascii=False, indent=2)
    logs.append(f"[ok] controlDict configured. mode={mode_norm}, endTime={et}, writeInterval={writeInterval}, app={base.get('application')}")
    log = "\n".join(logs)

except Exception as e:
    controlDict = ""
    log = f"[Error] {e}"
# ---------- end controldict ----------
fvsolution = CarbonflyFvSolution(mode="steady")  # -> fvSolution_path; inputs mode: String
#   port mode: Simulation mode: transient or steady-state
#   port fvSolution_path: fvSolution template path
# ---------- fvsolution: Python ----------
# GH inputs:
#   mode (Text)      # "steady" or "transient"
# GH outputs:
#   fvSolution_path (Text)   # path of fvSolution template
from carbonfly.fv_writer import get_template_path

norm = str(mode) if mode else "transient"
fvSolution_path = str(get_template_path("fvSolution", norm))
# ---------- end fvsolution ----------
fvschemes = CarbonflyFvSchemes(mode="steady")  # -> fvSchemes_path; inputs mode: String
#   port mode: Simulation mode: transient or steady-state
#   port fvSchemes_path: fvSchemes template path
# ---------- fvschemes: Python ----------
# GH inputs:
#   mode (Text)      # "steady" or "transient"
# GH outputs:
#   fvSchemes_path (Text)   # path of fvSchemes template
import sys, os
from pathlib import Path

from carbonfly.fv_writer import get_template_path

norm = str(mode) if mode else "transient"
p = get_template_path("fvSchemes", norm)
fvSchemes_path = str(p)
# ---------- end fvschemes ----------
panel_27 = Panel(controldict.controlDict)
panel_28 = Panel(controldict.log)
panel_29 = Panel(fvsolution)
panel_30 = Panel(fvschemes)

# ----
# Unit setting in your Rhino
panel_31 = Panel("mm")

# ----
# 5. Generate carbonfly case
# Click here to run!
number_slider_6 = Slider(2100, range=0..5000)
pt_6 = ConstructPoint(XCoordinate=Slider(600, range=0..5000), YCoordinate=number_slider_6, ZCoordinate=Slider(1500, range=0..5000))
residual_control = CarbonflyResidualControlList({"1e-4", "1e-5", "1e-6"}, selected="1e-5")
run = BooleanToggle(False)
createcfcase = CreateCarbonflyCase(
    case_dir="C:\Data\Carbonfly",
    case_name="03c_simple_nat_vent_human_lod0_boundingbox",
    CF_geo=merge_2,
    unit=panel_31,
    controlDict=controldict.controlDict,
    fvSchemes_path=fvschemes,
    fvSolution_path=fvsolution,
    residual=residual_control,
    insidePoint=pt_6,
    internalFields=internalfields.internalFields,
    run=run)  # -> log, case_path; inputs case_dir: String, case_name: String, CF_geo: list, unit: String, fvSchemes_path: String, fvSolution_path: String, insidePoint: Point3d, run: Boolean
#   port case_dir: OpenFOAM case root folder (creates 0/, system/, constant/triSurface/, etc.).
#   port case_name: Carbonfly case name
#   port CF_geo: List of Carbonfly Geometry objects (from CreateCFGeometry).
#   port unit: "mm" (default), "cm", "m" -> scaled to meters on export.
#   port controlDict: Carbonfly controlDict
#   port fvSchemes_path: fvSchemes template path
#   port fvSolution_path: fvSolution template path
#   port residual: Residual control, e.g. 1e-5
#   port insidePoint: A reference point inside the mesh/room
#   port internalFields: Carbonfly internalFields
#   port run: When True, create Carbonfly case
#   port case_path: Carbonfly case path
# ---------- createcfcase: Python ----------
# GH inputs:
#   case_dir (Text)
#   case_name (Text)
#   CF_geo (List)
#   unit (Text)     # optional, m / cm / mm
#   controlDict
#   fvSchemes_path
#   fvSolution_path
#   residual
#   insidePoint     # optional, reference point inside mesh
#   internalFields
#   run (Boolean)
# GH outputs:
#   log (Text)
#   case_path (Text)

import re
import json
from collections.abc import Sequence
from pathlib import Path
import carbonfly.case as cfcase
import carbonfly.control_dict as cfdict
from carbonfly.utils import unit_scale_to_m
from carbonfly.fv_writer import copy_fv_templates_to_case, patch_fvSolution_pimple

def _safe_name(s):
    s = (s or "unnamed").strip()
    s = re.sub(r"[^\w\-]+", "_", s)
    return s or "unnamed"

def _norm_unit(u):
    u = (u or "mm").strip().lower()
    if u not in ("mm", "cm", "m"):
        raise ValueError("unit must be 'mm', 'cm', or 'm'")
    return u

def _norm_path(p):
    if not p:
        return None
    s = str(p).strip()
    return Path(s) if s else None


def _norm_residual(v):
    if v is None:
        return None
    if isinstance(v, (int, float)):
        return float(v)
    s = str(v).strip()
    if s == "":
        return None
    return float(s)

def _parse_inside_point(p):
    """
    Accepts: Rhino Point3d / Vector3d / GH_Point(.Value) / [x, y, z] / (possibly [point]).
    Returns (x, y, z) or None if not parseable.
    """
    if p is None:
        return None

    # Unwrap singletons like [point]
    if isinstance(p, (list, tuple)) and len(p) == 1:
        p = p[0]

    # RhinoCommon Point3d / Vector3d or any object with X/Y/Z attrs
    if hasattr(p, "X") and hasattr(p, "Y") and hasattr(p, "Z"):
        try:
            return (float(p.X), float(p.Y), float(p.Z))
        except Exception:
            pass

    v = getattr(p, "Value", None) or getattr(p, "Location", None)
    if v is not None and hasattr(v, "X") and hasattr(v, "Y") and hasattr(v, "Z"):
        try:
            return (float(v.X), float(v.Y), float(v.Z))
        except Exception:
            pass

    # Generic sequence [x, y, z]
    if isinstance(p, Sequence) and not isinstance(p, (str, bytes)):
        if len(p) >= 3:
            try:
                return (float(p[0]), float(p[1]), float(p[2]))
            except Exception:
                pass

    return None

logs = []
try:
    # validations
    if not case_dir or not str(case_dir).strip():
        raise ValueError("case_dir is required.")
    if not CF_geo or len(CF_geo) == 0:
        raise ValueError("CF_geo is empty, please connect the output from CreateCFGeometry.")

    base_dir   = Path(str(case_dir)).expanduser()
    folder     = _safe_name(case_name)
    target_dir = base_dir / folder
    case_path  = str(target_dir)

    stl_name = "model.stl"
    unit_in  = _norm_unit(unit)
    scale_to_m = unit_scale_to_m(unit_in)

    # blockMesh settings
    pad_m = 1.0
    cell_m = 0.25

    # insidePoint
    inside_pt_model = _parse_inside_point(insidePoint)  # in model units
    inside_pt = tuple(c * scale_to_m for c in inside_pt_model) if inside_pt_model else None

    # default internalFields if not given
    U_internal      = [0.0, 0.0, 0.0]
    T_internal      = 295.15
    CO2_internal    = 0.000400
    P_internal      = 100_000.0
    P_rgh_internal  = 0
    alphat_internal = 0
    epsilon_internal= 0.01
    G_internal      = 0
    k_internal      = 0.1
    nut_internal    = 0
    Ydefault_internal   = 0

    fields = None
    if internalFields:
        fields = json.loads(internalFields)
                        
    if isinstance(fields, dict):
        U_internal      = fields.get("U",   U_internal)
        T_internal      = fields.get("T",   T_internal)
        CO2_internal    = fields.get("CO2", CO2_internal)
        P_internal      = fields.get("p",   P_internal)
        P_rgh_internal  = fields.get("p_rgh",   P_rgh_internal)
        alphat_internal = fields.get("alphat",   alphat_internal)
        epsilon_internal= fields.get("epsilon",   epsilon_internal)
        G_internal      = fields.get("G",   G_internal)
        k_internal      = fields.get("k",   k_internal)
        nut_internal    = fields.get("nut",   nut_internal)
        Ydefault_internal   = fields.get("Ydefault",   Ydefault_internal)

    # unpack controlDict
    cdict_json = None
    if controlDict:
        cdict_json = json.loads(controlDict)

    # fvSchemes & fvSolution
    fvSchemes_src = _norm_path(fvSchemes_path)
    fvSolution_src = _norm_path(fvSolution_path)

    # PIMPLE settings
    rv = _norm_residual(residual)

    if not run:
        # dry-run: no filesystem writes
        logs.append(f"Case will be created at: {target_dir}")
        logs.append(f"STL file: {stl_name}, unit: {unit_in}")
        logs.append(f"CF_geo count: {len(CF_geo)}")
        logs.append(f"blockMesh: padding_m={pad_m}, cell_size_m={cell_m}")
        logs.append("U_internal: " + (f"{U_internal} m/s" if U_internal else "None"))
        logs.append("T_internal: " + (f"{T_internal} K" if (T_internal is not None) else "None"))
        logs.append("CO2_internal: " + (f"{CO2_internal*1e6} ppm" if (CO2_internal is not None) else "None"))
        logs.append("P_internal: " + (f"{P_internal} Pa" if (P_internal is not None) else "None"))

        logs.append("P_rgh_internal: " + (f"{P_rgh_internal}" if (P_rgh_internal is not None) else "None"))
        logs.append("alphat_internal: " + (f"{alphat_internal}" if (alphat_internal is not None) else "None"))
        logs.append("epsilon_internal: " + (f"{epsilon_internal}" if (epsilon_internal is not None) else "None"))
        logs.append("G_internal: " + (f"{G_internal}" if (G_internal is not None) else "None"))
        logs.append("k_internal: " + (f"{k_internal}" if (k_internal is not None) else "None"))
        logs.append("nut_internal: " + (f"{nut_internal}" if (nut_internal is not None) else "None"))
        logs.append("Ydefault_internal: " + (f"{Ydefault_internal}" if (Ydefault_internal is not None) else "None"))
        if inside_pt is not None:
            logs.append(f"insidePoint (model units): {inside_pt_model}")
        else:
            logs.append("insidePoint: Default (Warning: may cause error))")
        if fvSchemes_src:
            logs.append(f"fvSchemes template: {fvSchemes_src}")
        else:
            logs.append("fvSchemes template not provided")
        if fvSolution_src:
            logs.append(f"fvSolution template: {fvSolution_src}")
        else:
            logs.append("fvSolution template not provided")
        logs.append(f"Residual: {rv if rv is not None else '(not provided)'}")

        logs.append("\n=== Click RUN to generate files ===")
        log = "\n".join(logs)
    else:
        # real writes
        logs.append(f"[Run] Creating case at: {target_dir}")
        # build case
        lgs, paths = cfcase.build_case(
            case_root=target_dir,
            cfgeos=CF_geo,
            stl_file_name=stl_name,
            unit=unit_in,
            internal_U=U_internal,
            internal_T=T_internal,
            internal_CO2=CO2_internal,
            internal_P=P_internal,
            internal_P_rgh=P_rgh_internal,
            internal_alphat=alphat_internal,
            internal_epsilon=epsilon_internal,
            internal_k=k_internal,
            internal_nut=nut_internal,
            internal_G=G_internal,
            internal_Ydefault=Ydefault_internal,
            write_blockmesh=True,
            padding_m=pad_m,
            cell_size_m=cell_m,
            write_snappy=True,
            inside_point=inside_pt,
            write_constant=True,
            write_fv=True,
            fvSchemes_path=fvSchemes_src,
            fvSolution_path=fvSolution_src
        )
        
        # controDict
        if cdict_json:
            cpath = cfdict.write_control_dict_from_json(target_dir, json.dumps(cdict_json))
            logs.append(f"controlDict written: {cpath}")
        
        # patch PIMPLE settings in fvSolution
        patched_path = patch_fvSolution_pimple(
            fvsolution_path=paths["fvSolution"],
            pRefPoint=inside_pt,
            residual_value=rv
        )
        logs.append(f"fvSolution patched: {patched_path}")

        # summary
        logs.append("\n==== summary ====\n")
        if 'stl' in paths:       logs.append(f"STL:               {paths.get('stl')}")
        if 'blockMesh' in paths: logs.append(f"blockMeshDict:     {paths.get('blockMesh')}")
        if 'snappy' in paths:    logs.append(f"snappyHexMeshDict: {paths.get('snappy')}")
        if 'U' in paths:         logs.append(f"0/U:               {paths['U']}")
        if 'T' in paths:         logs.append(f"0/T:               {paths['T']}")
        if 'CO2' in paths:       logs.append(f"0/CO2:             {paths['CO2']}")
        if 'p' in paths:         logs.append(f"0/p:               {paths['p']}")
        if 'p_rgh' in paths:     logs.append(f"0/p_rgh:           {paths['p_rgh']}")
        if 'alphat' in paths:    logs.append(f"0/alphat:          {paths['alphat']}")
        if 'epsilon' in paths:   logs.append(f"0/epsilon:         {paths['epsilon']}")
        if 'k' in paths:         logs.append(f"0/k:               {paths['k']}")
        if 'nut' in paths:       logs.append(f"0/nut:             {paths['nut']}")
        if 'G' in paths:         logs.append(f"0/G:               {paths['G']}")
        if 'Ydefault' in paths:  logs.append(f"0/Ydefault:        {paths['Ydefault']}")

        if inside_pt is not None:
            logs.append(f"insidePoint used: {inside_pt}")
        if 'fvSchemes' in paths:  logs.append(f"fvSchemes:         {paths['fvSchemes']}")
        if 'fvSolution' in paths: logs.append(f"fvSolution:         {paths['fvSolution']}")
        logs += lgs
        log = "\n".join(logs)

except Exception as e:
    case_path = ""
    log = f"[Error] {e}"
# ---------- end createcfcase ----------
panel_32 = Panel(createcfcase.log)
panel_33 = Panel(createcfcase.case_path)

# ----
# Your WSL distribution
panel_34 = Panel("Ubuntu-20.04")

# ----
# Step 3 - snappyHexMesh:
# generates a body-fitted mesh around geometry by refining and snapping cells
# Click here to run!
run_2 = BooleanToggle(False)
snappyhexmesh = CarbonflySnappyHexMesh(case_path=createcfcase.case_path, distro=panel_34, run=run_2)  # -> log; inputs case_path: String, distro: String, foam_bashrc: String, run: Boolean
#   port case_path: Carbonfly case path
#   port distro: Name of the WSL distribution/profile to run the command in (e.g., “Ubuntu-22.04”); leave blank to use your default WSL.
#   port foam_bashrc: Path to the OpenFOAM bashrc file to source before running the command (e.g., “/opt/openfoam10/etc/bashrc”); leave blank to skip sourcing/use the current environment.
#   port run: When True, run snappyHexMesh
# ---------- snappyhexmesh: Python ----------
# GH inputs:
#   case_path (Text)
#   run (Boolean)
# GH outputs:
#   log (Text)

from pathlib import Path

from carbonfly.wsl import run_snappy_console

def _win_to_wsl_path(p: str) -> str:
    """Convert a Windows path to a WSL path (/mnt/<drive>/...). Minimal but sufficient here."""
    p = str(p).replace("\\", "/")
    if len(p) >= 2 and p[1] == ":":
        return f"/mnt/{p[0].lower()}/{p[2:]}"
    return p

logs = []
try:
    # Validate inputs
    if not case_path or not str(case_path).strip():
        raise ValueError("case_path is required (full path to the case folder).")

    case_dir = Path(str(case_path)).expanduser()
    dict_file = case_dir / "system" / "snappyHexMeshDict"
    emesh_file = case_dir / "constant" / "triSurface" / "model.eMesh"

    # Basic preflight info
    logs.append(f"Case: {case_dir}")
    logs.append(f"snappyHexMeshDict: {dict_file}")
    logs.append(f"eMesh: {emesh_file}")

    # Existence checks
    dict_exists = dict_file.is_file()
    emesh_exists = emesh_file.is_file()

    if not run:
        # Dry-run: do not execute
        if dict_exists:
            logs.append("[Check] snappyHexMeshDict found.")
        else:
            logs.append("[Check] snappyHexMeshDict NOT found (run CreateCFCase first).")

        if emesh_exists:
            logs.append("[Check] eMesh found.")
        else:
            logs.append("[Check] eMesh NOT found. Run the surfaceFeatures component first.")

        logs.append("")
        logs.append("This component will execute:  snappyHexMesh -overwrite")
        logs.append("\n=== Click RUN to start snappyHexMesh ===")
        log = "\n".join(str(x) for x in logs)

    else:
        # On run: enforce required files
        if not dict_exists:
            raise FileNotFoundError("system/snappyHexMeshDict not found. Generate the case first.")
        if not emesh_exists:
            raise FileNotFoundError("constant/triSurface/model.eMesh not found. Run surfaceFeatures first.")

        logs.append("")
        logs.append("[Run] Launching snappyHexMesh -overwrite ...")

        rc = run_snappy_console(
            case_root=case_dir,
            foam_bashrc=(foam_bashrc or "/opt/openfoam10/etc/bashrc"),
            distro=distro or None,
        )

        if rc == 0:
            logs.append("[OK] Please check the console opened.")
            logs.append("Check constant/polyMesh and logs under 'system/'.")
        else:
            logs.append(f"[Warning] snappyHexMesh exited with return code: {rc}")
            logs.append("Please review the console output and OpenFOAM logs for details.")

        log = "\n".join(str(x) for x in logs)

except Exception as e:
    log = f"[Error] {e}"
# ---------- end snappyhexmesh ----------
panel_35 = Panel(snappyhexmesh)

# ----
# Step 2 - surfaceFeatures:
# extracts sharp edges/features from surface geometry
# Click here to run!
run_3 = BooleanToggle(False)
surfacefeatures = CarbonflySurfaceFeatures(case_path=createcfcase.case_path, distro=panel_34, run=run_3)  # -> log; inputs case_path: String, distro: String, foam_bashrc: String, run: Boolean
#   port case_path: Carbonfly case path
#   port distro: Name of the WSL distribution/profile to run the command in (e.g., “Ubuntu-22.04”); leave blank to use your default WSL.
#   port foam_bashrc: Path to the OpenFOAM bashrc file to source before running the command (e.g., “/opt/openfoam10/etc/bashrc”); leave blank to skip sourcing/use the current environment.
#   port includedAngleDeg: includedAngleDeg for surfaceFeatures, default: 150 degree
#   port run: When True, run surfaceFeatures
# ---------- surfacefeatures: Python ----------
# GH inputs:
#   case_path (Text)          # full path including the case folder
#   includedAngleDeg (Number) # optional, default 150
#   run (Boolean)
# GH outputs:
#   log (Text)

from pathlib import Path

# Library APIs
from carbonfly.snappy_writer import write_surface_features_dict
from carbonfly.wsl import run_surface_features_console

def _win_to_wsl_path(p: str) -> str:
    """Convert a Windows path to a WSL path (/mnt/<drive>/...). Minimal but sufficient here."""
    p = str(p).replace("\\", "/")
    if len(p) >= 2 and p[1] == ":":
        return f"/mnt/{p[0].lower()}/{p[2:]}"
    return p

logs = []
try:
    if not case_path or not str(case_path).strip():
        raise ValueError("case_path is required (full path including the case folder).")

    target_dir = Path(str(case_path)).expanduser()
    stl_name   = "model.stl"  # fixed name
    angle      = float(includedAngleDeg) if (includedAngleDeg is not None) else 150.0

    dict_file   = target_dir / "system" / "surfaceFeaturesDict"
    emesh_file  = target_dir / "constant" / "triSurface" / "model.eMesh"

    if not run:
        # Dry-run: nothing written, just tell the user what will happen.
        logs.append("surfaceFeaturesDict will be created:")
        logs.append(f"  {dict_file}")
        logs.append(f"STL file: {stl_name}")
        logs.append(f"includedAngle: {angle:.0f} deg")
        logs.append("After that, the component will run `surfaceFeatures` to create the eMesh:")
        logs.append(f"  {emesh_file}")
        logs.append("")
        logs.append("=== Click RUN to write the dict and execute surfaceFeatures ===")
        log = "\n".join(str(x) for x in logs)

    else:
        # 1) Write system/surfaceFeaturesDict
        target_dir.mkdir(parents=True, exist_ok=True)
        out_path = write_surface_features_dict(
            case_root=target_dir,
            stl_file_name=stl_name,
            included_angle_deg=angle
        )
        logs.append("[OK] surfaceFeaturesDict written:")
        logs.append(f"  {out_path}")

        # 2) Run surfaceFeatures in a real console via WSL
        logs.append("")
        logs.append("[Run] Executing `surfaceFeatures` to generate the eMesh...")
        
        rc = run_surface_features_console(
            case_root=target_dir,
            foam_bashrc=(foam_bashrc or "/opt/openfoam10/etc/bashrc"),
            distro=distro or None,
        )
        
        if rc == 0:
            logs.append("[OK] Please check the console opened.")
            logs.append(f"eMesh created at (expected):")
            logs.append(f"  {emesh_file}")
        else:
            logs.append(f"[Warning] surfaceFeatures exited with return code: {rc}")
            logs.append("Please check the console output and any OpenFOAM logs for details.")

        log = "\n".join(str(x) for x in logs)

except Exception as e:
    log = f"[Error] {e}"
# ---------- end surfacefeatures ----------
panel_36 = Panel(surfacefeatures)

# ----
# 6. Run simulation
# Step 1 - blockMesh:
# creates a simple background mesh from block definitions
# Click here to run!
run_4 = BooleanToggle(False)
blockmesh = CarbonflyBlockMesh(case_path=createcfcase.case_path, distro=panel_34, run=run_4)  # -> log; inputs case_path: String, distro: String, foam_bashrc: String, run: Boolean
#   port case_path: Carbonfly case path
#   port distro: Name of the WSL distribution/profile to run the command in (e.g., “Ubuntu-22.04”); leave blank to use your default WSL.
#   port foam_bashrc: Path to the OpenFOAM bashrc file to source before running the command (e.g., “/opt/openfoam10/etc/bashrc”); leave blank to skip sourcing/use the current environment.
#   port run: When True, run blockMesh
# ---------- blockmesh: Python ----------
# GH inputs:
#   case_path (Text)
#   run (Boolean)
#   distro (Text)          # optional, e.g. "Ubuntu-22.04"
#   foam_bashrc (Text)     # optional, e.g. "/opt/openfoam10/etc/bashrc"
# GH outputs:
#   log (Text)

from pathlib import Path
import carbonfly.wsl as cfwsl

if run and case_path:
    rc = cfwsl.run_blockmesh_console(
        Path(case_path),
        distro=distro or None,
        foam_bashrc=(foam_bashrc or "/opt/openfoam10/etc/bashrc"),
    )
    log = "blockMesh finished with return code {}\n".format(rc)
    log += "[OK] Please check the console opened."
else:
    log = "=== Click RUN to open console and run blockMesh ==="
# ---------- end blockmesh ----------
panel_37 = Panel(blockmesh)

# ----
# Step 4 - checkMesh:
# checks mesh quality (non-orthogonality, skewness, aspect ratio, etc.)
# Click here to run!
run_5 = BooleanToggle(False)
checkmesh = CarbonflyCheckMesh(case_path=createcfcase.case_path, distro=panel_34, run=run_5)  # -> log; inputs case_path: String, distro: String, foam_bashrc: String, run: Boolean
#   port case_path: Carbonfly case path
#   port distro: Name of the WSL distribution/profile to run the command in (e.g., “Ubuntu-22.04”); leave blank to use your default WSL.
#   port foam_bashrc: Path to the OpenFOAM bashrc file to source before running the command (e.g., “/opt/openfoam10/etc/bashrc”); leave blank to skip sourcing/use the current environment.
#   port run: When True, run checkMesh
# ---------- checkmesh: Python ----------
# GH inputs:
#   case_path (Text)   # full path to the case folder
#   run (Boolean)
# GH outputs:
#   log (Text)

from pathlib import Path

from carbonfly.wsl import run_check_mesh_console

def _win_to_wsl_path(p: str) -> str:
    """Convert a Windows path to a WSL path (/mnt/<drive>/...). Minimal but sufficient here."""
    p = str(p).replace("\\", "/")
    if len(p) >= 2 and p[1] == ":":
        return f"/mnt/{p[0].lower()}/{p[2:]}"
    return p

logs = []
try:
    # Validate inputs
    if not case_path or not str(case_path).strip():
        raise ValueError("case_path is required (full path to the case folder).")

    case_dir = Path(str(case_path)).expanduser()

    if not run:
        # Dry-run: do not execute
        logs.append("This component will execute:  checkMesh")
        logs.append("\n=== Click RUN to start checkMesh ===")
        log = "\n".join(str(x) for x in logs)

    else:
        # On run: enforce required files
        logs.append("")
        logs.append("[Run] Launching checkMesh ...")

        rc = run_check_mesh_console(
            case_root=case_dir,
            foam_bashrc=(foam_bashrc or "/opt/openfoam10/etc/bashrc"),
            distro=distro or None,
        )

        if rc == 0:
            logs.append("[OK] Please check the console opened.")
        else:
            logs.append(f"[Warning] checkMesh exited with return code: {rc}")
            logs.append("Please review the console output and OpenFOAM logs for details.")

        log = "\n".join(str(x) for x in logs)

except Exception as e:
    log = f"[Error] {e}"
# ---------- end checkmesh ----------
panel_38 = Panel(checkmesh)

# ----
# Step 5 - runFoam
# run OpenFOAM solver for simulation
# Click here to run!
run_6 = BooleanToggle(False)
runfoam = CarbonflyRunFoam(case_path=createcfcase.case_path, distro=panel_34, run=run_6)  # -> log; inputs case_path: String, distro: String, foam_bashrc: String, run: Boolean
#   port case_path: Carbonfly case path
#   port distro: Name of the WSL distribution/profile to run the command in (e.g., “Ubuntu-22.04”); leave blank to use your default WSL.
#   port foam_bashrc: Path to the OpenFOAM bashrc file to source before running the command (e.g., “/opt/openfoam10/etc/bashrc”); leave blank to skip sourcing/use the current environment.
#   port run: When True, run OpenFOAM
# ---------- runfoam: Python ----------
# GH inputs:
#   case_path (Text)
#   run (Boolean)
# GH outputs:
#   log (Text)

from pathlib import Path

from carbonfly.wsl import run_foam_console

def _win_to_wsl_path(p: str) -> str:
    """Convert a Windows path to a WSL path (/mnt/<drive>/...). Minimal but sufficient here."""
    p = str(p).replace("\\", "/")
    if len(p) >= 2 and p[1] == ":":
        return f"/mnt/{p[0].lower()}/{p[2:]}"
    return p

logs = []
try:
    # Validate inputs
    if not case_path or not str(case_path).strip():
        raise ValueError("case_path is required (full path to the case folder).")

    case_dir = Path(str(case_path)).expanduser()

    if not run:
        # Dry-run: do not execute
        logs.append("This component will execute:  buoyantReactingFoam")
        logs.append("\n=== Click RUN to start simulation ===")
        log = "\n".join(str(x) for x in logs)

    else:
        # On run: enforce required files
        logs.append("")
        logs.append("[Run] Launching buoyantReactingFoam ...")

        rc = run_foam_console(
            case_root=case_dir,
            foam_bashrc=(foam_bashrc or "/opt/openfoam10/etc/bashrc"),
            distro=distro or None,
        )

        if rc == 0:
            logs.append("[OK] Please check the console opened.")
        else:
            logs.append(f"[Warning] buoyantReactingFoam exited with return code: {rc}")
            logs.append("Please review the console output and OpenFOAM logs for details.")

        log = "\n".join(str(x) for x in logs)

except Exception as e:
    log = f"[Error] {e}"
# ---------- end runfoam ----------
panel_39 = Panel(runfoam)

# ----
# Step 6 - foamMonitor (optional):
# live monitoring tool to track residuals during simulation
# Click here to run!
# Before closing Grasshopper, remember to switch the Run button
# back to False, otherwise it will run automatically the next time you open it!
run_7 = BooleanToggle(False)
foammonitor = CarbonflyFoamMonitor(case_path=createcfcase.case_path, distro=panel_34, run=run_7)  # -> log; inputs case_path: String, distro: String, foam_bashrc: String, start_time: Double, run: Boolean
#   port case_path: Carbonfly case path
#   port distro: Name of the WSL distribution/profile to run the command in (e.g., “Ubuntu-22.04”); leave blank to use your default WSL.
#   port foam_bashrc: Path to the OpenFOAM bashrc file to source before running the command (e.g., “/opt/openfoam10/etc/bashrc”); leave blank to skip sourcing/use the current environment.
#   port start_time: Monitor residuals from time/iteration {start_time}, default: 0
#   port run: When True, run foamMonitor
# ---------- foammonitor: Python ----------
# GH inputs:
#   case_path (Text)
#   start_time (Float)
#   run (Boolean)
# GH outputs:
#   log (Text)

from pathlib import Path

from carbonfly.wsl import run_foam_monitor_console

def _win_to_wsl_path(p: str) -> str:
    """Convert a Windows path to a WSL path (/mnt/<drive>/...). Minimal but sufficient here."""
    p = str(p).replace("\\", "/")
    if len(p) >= 2 and p[1] == ":":
        return f"/mnt/{p[0].lower()}/{p[2:]}"
    return p

logs = []
try:
    # Validate inputs
    if not case_path or not str(case_path).strip():
        raise ValueError("case_path is required (full path to the case folder).")

    case_dir = Path(str(case_path)).expanduser()

    if start_time is None:
        start_time = 0

    if not run:
        # Dry-run: do not execute
        logs.append(f"This component will execute:  `foamMonitor -l postProcessing/residuals/{start_time}/residuals.dat`")
        logs.append("\n=== Click RUN to start foamMonitor ===")
        log = "\n".join(str(x) for x in logs)

    else:
        # On run: enforce required files
        logs.append("")
        logs.append("[Run] Launching foamMonitor ...")

        rc = run_foam_monitor_console(
            case_root=case_dir,
            foam_bashrc=(foam_bashrc or "/opt/openfoam10/etc/bashrc"),
            distro=distro or None,
            start_time=start_time
        )

        if rc == 0:
            logs.append("[OK] Please check the console opened.")
        else:
            logs.append(f"[Warning] foamMonitor exited with return code: {rc}")
            logs.append("Please review the console output and OpenFOAM logs for details.")

        log = "\n".join(str(x) for x in logs)

except Exception as e:
    log = f"[Error] {e}"
# ---------- end foammonitor ----------
panel_40 = Panel(foammonitor)

# ==== cluster ManikinLOD0: Create a manikin with Level of Details of 0
angle = ClusterInput()
unit = ClusterInput()
width = ClusterInput()
height = ClusterInput()
stv_height = ClusterInput()
activity = ClusterInput()
breathing_flow_rate = ClusterInput()
mouth_scaling = ClusterInput()
base_point = ClusterInput()
py3 = Python3Script(
    unit=unit,
    width=width,
    height=height,
    StV_height=stv_height,
    activity=activity,
    breathing_flow_rate=breathing_flow_rate,
    mouth_scaling=mouth_scaling,
    angle=angle)  # -> width, height, stv_height, mouth_w, mouth_h, angle, breathing_U; inputs unit: String, width: Double, height: Double, StV_height: Double, activity: String, breathing_flow_rate: Double, mouth_scaling: Double
#   port unit: "mm" (default), "cm", "m"
#   port StV_height: Stomion (mouth) to vertex height. For reference: 1) Adult: ~16-17 cm (females) / ~17-18 cm (males); 2) Children (6–12 years): ~12-15 cm
#   port activity: The level of activity: "light" / "medium" / "heavy", affects the size of the mouth opening
#   port breathing_flow_rate: Average breathing flow rate in L/min, default: 7.2 (light activity) / 18 (medium) / 60 (heavy)
#   port mouth_scaling: Mouth opening scaling factor: 1 - 5, default: 3. A larger scale factor increases the mouth's opening area, reducing velocity while maintaining flow rate, thereby simplifying the mesh.
#   port angle: Rotation angles in radians
#   port breathing_U: Breathing velocity U in m/s
# ---------- py3: Python ----------
if unit == "m":
    _scale_factor = 1e-3
elif unit == "cm":
    _scale_factor = 1e-1
else:
    _scale_factor = 1

if StV_height is None:
    StV_height = 170 * _scale_factor

if mouth_scaling is None:
    _mouth_scaling = 4
elif mouth_scaling < 1:
    _mouth_scaling = 1
elif mouth_scaling > 5:
    _mouth_scaling = 5
else:
    _mouth_scaling = mouth_scaling

if angle is None:
    _angle = 0
else:
    _angle = angle

# width = [200, 800] mm
_width = min(max(width, 200 * _scale_factor), 800 * _scale_factor)

# height = [500, 2200] mm
_height = min(max(height, 500 * _scale_factor), 2200 * _scale_factor)

# stomia to vertex height = [120, 200] mm
_stv_height = min(max(StV_height, 120 * _scale_factor), 200 * _scale_factor)

if activity == "medium":
    # ~3 cm^2
    _mouth_w = 40 * _mouth_scaling * _scale_factor   # 4 cm
    _mouth_h = 7.5 * _mouth_scaling * _scale_factor    # 0.75 cm
elif activity == "heavy":
    # ~6 cm^2
    _mouth_w = 40 * _mouth_scaling * _scale_factor   # 4 cm
    _mouth_h = 12.5 * _mouth_scaling * _scale_factor    # 1.25 cm
else:
    # ~1 cm^2
    _mouth_w = 20 * _mouth_scaling * _scale_factor   # 2 cm
    _mouth_h = 5 * _mouth_scaling * _scale_factor   # 0.5 cm


# breathing_U
if breathing_flow_rate is None:
    if activity == "heavy":
        breathing_flow_rate = 60.0   # L/min
    elif activity == "medium":
        breathing_flow_rate = 18.0   # L/min
    else:
        breathing_flow_rate = 7.2    # L/min

# clamp to a reasonable range
breathing_flow_rate = float(min(max(breathing_flow_rate, 1.0), 200.0))

# calculate breathing_U in m/s
if unit == "m":
    _mouth_area = _mouth_w * _mouth_h           # m^2
elif unit == "cm":
    _mouth_area = (_mouth_w * _mouth_h) * 1e-4  # cm^2 -> m^2
else:
    _mouth_area = (_mouth_w * _mouth_h) * 1e-6  # mm^2 -> m^2
# L/min -> m^3/s
_breathing_Q_m3s = breathing_flow_rate * (1e-3 / 60.0)
# velocity (m/s)
breathing_U = _breathing_Q_m3s / _mouth_area
# ---------- end py3 ----------
base_point_2 = Point(base_point)
division = Division(A=py3.width, B=2)
X = UnitX(Factor=division)
Y = UnitY(Factor=division)
neg = Negative(Value=X)
neg_2 = Negative(Value=Y)
neg_3 = Negative(Value=Y)
move = Move(Geometry=base_point_2, Motion=X)  # -> Geometry, Transform
move_2 = Move(Geometry=base_point_2, Motion=neg)  # -> Geometry, Transform
move_3 = Move(Geometry=move_2.Geometry, Motion=Y)  # -> Geometry, Transform
move_4 = Move(Geometry=move.Geometry, Motion=neg_2)  # -> Geometry, Transform
move_5 = Move(Geometry=move.Geometry, Motion=Y)  # -> Geometry, Transform
move_6 = Move(Geometry=move_2.Geometry, Motion=neg_3)  # -> Geometry, Transform
srf4pt = _4PointSurface(CornerA=move_4.Geometry, CornerB=move_5.Geometry, CornerC=move_3.Geometry, CornerD=move_6.Geometry)
Z = UnitZ(Factor=200)
move_7 = Move(Geometry=srf4pt, Motion=Z)  # -> Geometry, Transform
Z_2 = UnitZ(Factor=py3.height)
extr = Extrude(Base=move_7.Geometry, Direction=Z_2)
debrep = DeconstructBrep(Brep=extr)  # -> Faces, Edges, Vertices
item = ListItem(List=debrep.Faces, Index=Slider(5, range=0..6), Wrap=True)
item_2 = ListItem(List=debrep.Faces, Index=Slider(2, range=0..6), Wrap=True)
item_3 = ListItem(List=debrep.Faces, Index=Slider(3, range=0..6), Wrap=True)
item_4 = ListItem(List=debrep.Faces, Index=Slider(0, range=0..6), Wrap=True)
item_5 = ListItem(List=debrep.Faces, Index=Slider(4, range=0..6), Wrap=True)
item_6 = ListItem(List=debrep.Edges, Index=Slider(5, range=0..6), Wrap=True)
item_7 = ListItem(List=debrep.Faces, Index=Slider(1, range=0..6), Wrap=True)
neg_4 = Negative(Value=py3.stv_height)
division_2 = Division(A=py3.mouth_w, B=2)
division_3 = Division(A=py3.mouth_h, B=2)
midpt = CurveMiddle(Curve=item_6)
Z_3 = UnitZ(Factor=neg_4)
Z_4 = UnitZ(Factor=division_3)
Y_2 = UnitY(Factor=division_2)
pcen = PolygonCenter(Polyline=item)  # -> CenterV, CenterE, CenterA
neg_5 = Negative(Value=Z_4)
move_8 = Move(Geometry=midpt, Motion=Z_3)  # -> Geometry, Transform
neg_6 = Negative(Value=Y_2)
move_9 = Move(Geometry=move_8.Geometry, Motion=Y_2)  # -> Geometry, Transform
move_10 = Move(Geometry=move_8.Geometry, Motion=neg_6)  # -> Geometry, Transform
ln = Line(StartPoint=pcen.CenterV, EndPoint=base_point_2)
move_11 = Move(Geometry=move_9.Geometry, Motion=Z_4)  # -> Geometry, Transform
move_12 = Move(Geometry=move_9.Geometry, Motion=neg_5)  # -> Geometry, Transform
move_13 = Move(Geometry=move_10.Geometry, Motion=Z_4)  # -> Geometry, Transform
move_14 = Move(Geometry=move_10.Geometry, Motion=neg_5)  # -> Geometry, Transform
srf4pt_2 = _4PointSurface(CornerA=move_12.Geometry, CornerB=move_11.Geometry, CornerC=move_13.Geometry, CornerD=move_14.Geometry)
sdiff = SolidDifference(BrepsA=item_7, BrepsB=srf4pt_2)
merge = Merge(Data1=item, Data2=item_4, Data3=item_2, Data4=item_3, Data5=item_5, Data6=sdiff)
rotax = RotateAxis(Geometry=merge, Angle=py3.angle, Axis=ln)  # -> Geometry, Transform
rotax_2 = RotateAxis(Geometry=srf4pt_2, Angle=py3.angle, Axis=ln)  # -> Geometry, Transform
body = Surface(rotax.Geometry)
area = Area(Geometry=body)  # -> Area, Centroid
ma = MassAddition(Input=area.Area)  # -> Result, PartialResults
mouth = Surface(rotax_2.Geometry)
py3_2 = Python3Script(unit=unit, R=ma.Result)  # -> BSA
# ---------- py3_2: Python ----------
if unit == "m":
    BSA = R         # m^2
elif unit == "cm":
    BSA = R * 1e-4   # cm^2 -> m^2
else:
    BSA = R * 1e-6   # mm^2 -> m^2
# ---------- end py3_2 ----------
breathing_u = ClusterOutput(py3.breathing_U)
mouth_2 = ClusterOutput(mouth)
body_2 = ClusterOutput(body)
body_surface_area = Number(py3_2)
body_surface_area_2 = ClusterOutput(body_surface_area)
