# Grasshopper definition 04_thermal_comfort_Gagge_two_node_model.gh (Grasshopper 1.0.8)

# ----
# Sleeping
panel = Panel("175")
bsa_du_bois = BSADuBois(height=panel, weight="80")  # -> BSA; inputs height: Double, weight: Double
#   port BSA: Body Surface Area in m2
# ---------- bsa_du_bois: Python ----------
height = 0.0 if height is None or height <= 0 else height
weight = 0.0 if weight is None or weight <= 0 else weight

# BSA (m^2) / height (cm) /  weight (kg)
BSA = 0.007184 * (height ** 0.725) * (weight ** 0.425)
# ---------- end bsa_du_bois ----------
panel_2 = Panel(bsa_du_bois)
gagge_two_node_model_sleep = GaggeTwoNodeModelSleep(tdb="25", tr="25", v="0.3", rh="50", clo="0.5", thickness_quilt="3", height=panel, weight="80")  # -> e_skin, t_core, t_skin, skin_blood_flow, w, SET, disc, t_sens, met_shivering, alfa; inputs tdb: Double, tr: Double, v: Double, rh: Double, clo: Double, thickness_quilt: Double, wme: Double, p_atm: Double, height: Double, weight: Double, c_sw: Double, c_dil: Double, c_str: Double, temp_skin_neutral: Double, temp_core_neutral: Double, e_skin: Double, alfa: Double, skin_blood_flow: Double, met_shivering: Double
#   port tdb: Dry bulb air temperature, [°C].
#   port tr: Mean radiant temperature, [°C].
#   port v: Air speed, [m/s].
#   port rh: Relative humidity, [%].
#   port clo: Clothing insulation, [clo].
#   port thickness_quilt: Thickness of the quilt, [cm].
#   port wme: External work, [met]. Defaults to 0.
#   port p_atm: Atmospheric pressure, default value 101325 [Pa].
#   port height: Height of the person, [cm]. Defaults to 171.
#   port weight: Weight of the person, [kg]. Defaults to 70.
#   port c_sw: Driving coefficient for regulatory sweating. Defaults to 170.
#   port c_dil: Driving coefficient for vasodilation. Defaults to 120.
#   port c_str: Driving coefficient for vasoconstriction. Defaults to 0.5.
#   port temp_skin_neutral: Skin temperature at neutral conditions, [°C]. Defaults to 33.7.
#   port temp_core_neutral: Core temperature at neutral conditions, [°C]. Defaults to 36.8.
#   port e_skin: Total evaporative heat loss, [W]. Defaults to 0.094.
#   port alfa: Dynamic fraction of total body mass assigned to the skin node. Defaults to 0.1.
#   port skin_blood_flow: Skin-blood-flow rate per unit surface area, [kg/h/m2]. Defaults to 6.3.
#   port met_shivering: Metabolic rate due to shivering, [met]. Defaults to 0.
#   port e_skin: Total rate of evaporative heat loss from skin, [W/m2]. Equal to e_rsw + e_diff.
#   port t_core: Core temperature, [°C].
#   port t_skin: Skin temperature, [°C].
#   port skin_blood_flow: Skin blood flow, [kg/h/m2].
#   port w: Skin wettedness, adimensional. Ranges from 0 to 1.
#   port SET: Standard Effective Temperature (SET).
#   port disc: Thermal discomfort (DISC). DISC is described numerically as: comfortable and pleasant (0), slightly uncomfortable but acceptable (1), uncomfortable and unpleasant (2), very uncomfortable (3), limited tolerance (4), and intolerable (5). The range of each category is ± 0.5 numerically.
#   port t_sens: Predicted Thermal Sensation.
#   port met_shivering: Metabolic rate due to shivering, [W/m2].
#   port alfa: Dynamic fraction of total body mass assigned to the skin node (dimensionless).
# ---------- gagge_two_node_model_sleep: Python ----------
from carbonfly.pythermalcomfort.models import two_nodes_gagge_sleep

result = two_nodes_gagge_sleep(
    tdb=tdb, 
    tr=tr, 
    v=v, 
    rh=rh, 
    clo=clo,
    thickness_quilt=thickness_quilt,
    wme=wme or 0,  
    p_atm=p_atm or 101325,
    height=height or 171,
    weight=weight or 70,
    c_sw=c_sw or 170,
    c_dil=c_dil or 120,
    c_str=c_str or 0.5,
    temp_skin_neutral=temp_skin_neutral or 33.7,
    temp_core_neutral=temp_core_neutral or 36.8,
    e_skin=e_skin or 0.094,
    alfa=alfa or 0.1,
    skin_blood_flow=skin_blood_flow or 6.3,
    met_shivering=met_shivering or 0,
)

e_skin = result["e_skin"]
t_core = result["t_core"]
t_skin = result["t_skin"]
skin_blood_flow=result["skin_blood_flow"]
w = result["wet"]
SET = result["set"]
t_sens = result["t_sens"]
disc = result["disc"]
met_shivering=result["met_shivering"]
alfa=result["alfa"]
# ---------- end gagge_two_node_model_sleep ----------
panel_3 = Panel(gagge_two_node_model_sleep.e_skin)
panel_4 = Panel(gagge_two_node_model_sleep.disc)
panel_5 = Panel(gagge_two_node_model_sleep.t_sens)
panel_6 = Panel(gagge_two_node_model_sleep.met_shivering)
panel_7 = Panel(gagge_two_node_model_sleep.alfa)
panel_8 = Panel(gagge_two_node_model_sleep.skin_blood_flow)
panel_9 = Panel(gagge_two_node_model_sleep.w)
panel_10 = Panel(gagge_two_node_model_sleep.SET)
panel_11 = Panel(gagge_two_node_model_sleep.t_core)
panel_12 = Panel(gagge_two_node_model_sleep.t_skin)

number_slider = Slider(4000, range=0..5000)
division = Division(A=number_slider, B=6)
division_2 = Division(A=number_slider, B=2)
pt = ConstructPoint(XCoordinate=0, YCoordinate=0, ZCoordinate=0)
pt_2 = ConstructPoint(XCoordinate=number_slider, YCoordinate=0, ZCoordinate=0)
pt_3 = ConstructPoint(XCoordinate=0, YCoordinate=number_slider, ZCoordinate=0)
pt_4 = ConstructPoint(XCoordinate=number_slider, YCoordinate=number_slider, ZCoordinate=0)
Z = UnitZ(Factor=Slider(3000, range=0..5000))
srf4pt = _4PointSurface(CornerA=pt, CornerB=pt_2, CornerC=pt_4, CornerD=pt_3)
X = UnitX(Factor=division_2)
Y = UnitY(Factor=division)
Y_2 = UnitY(Factor=division_2)
extr = Extrude(Base=srf4pt, Direction=Z)
debrep = DeconstructBrep(Brep=extr)  # -> Faces, Edges, Vertices
item = ListItem(List=debrep.Faces, Index=Slider(2, range=1..7), Wrap=True)
item_2 = ListItem(List=debrep.Faces, Index=Slider(3, range=1..7), Wrap=True)
item_3 = ListItem(List=debrep.Faces, Index=Slider(4, range=1..7), Wrap=True)
item_4 = ListItem(List=debrep.Faces, Index=Slider(5, range=1..7), Wrap=True)
item_5 = ListItem(List=debrep.Faces, Index=Slider(6, range=1..7), Wrap=True)
item_6 = ListItem(List=debrep.Faces, Index=Slider(1, range=1..7), Wrap=True)
scale_nu = ScaleNU(Geometry=item_4, Plane=PlaneXY(0, 0, 0), ScaleX=0.15, ScaleY=0.15, ScaleZ=1)  # -> Geometry, Transform
move = Move(Geometry=scale_nu.Geometry, Motion=Y)  # -> Geometry, Transform
move_2 = Move(Geometry=move.Geometry, Motion=X)  # -> Geometry, Transform
move_3 = Move(Geometry=move_2.Geometry, Motion=Y_2)  # -> Geometry, Transform
sdiff = SolidDifference(BrepsA=item_4, BrepsB=[move_2.Geometry, move_3.Geometry])
preview = CustomPreview(Geometry=move_2.Geometry, Material=ColourSwatch(SwatchColor=RGB(51, 255, 0)))
preview_2 = CustomPreview(Geometry=move_3.Geometry, Material=ColourSwatch(SwatchColor=RGB(255, 140, 0)))
preview_3 = CustomPreview(Geometry=sdiff, Material=ColourSwatch(SwatchColor=RGBA(0, 178, 255, 105)))
preview_4 = CustomPreview(Geometry=[item_6, item, item_2, item_3, item_5], Material=ColourSwatch(SwatchColor=RGBA(255, 255, 255, 105)))

bsa_du_bois_2 = BSADuBois(height="175", weight="75")  # -> BSA; inputs height: Double, weight: Double; same code as bsa_du_bois
panel_13 = Panel(bsa_du_bois_2)
# Standing or Sitting
panel_14 = Panel("25")
gagge_two_node_model = GaggeTwoNodeModel(tdb=panel_14, tr="25", v="0.3", rh="50", met="1.2", clo="0.5", BSA=bsa_du_bois_2, position="sitting")  # -> e_skin, e_rsw, e_max, q_sensible, q_skin, q_res, t_core, t_skin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; inputs tdb: Double, tr: Double, v: Double, rh: Double, met: Double, clo: Double, wme: Double, BSA: Double, p_atm: Double, position: String, max_skin_blood_flow: Double, max_sweating: Double, w_max: Double
#   port tdb: Dry bulb air temperature, [°C].
#   port tr: Mean radiant temperature, [°C].
#   port v: Air speed, [m/s].
#   port rh: Relative humidity, [%].
#   port met: Metabolic rate, [met].
#   port clo: Clothing insulation, [clo].
#   port wme: External work, [met]. Defaults to 0.
#   port BSA: Body surface area, default value 1.8258 [m2].
#   port p_atm: Atmospheric pressure, default value 101325 [Pa].
#   port position: Select either “sitting” or “standing”. Defaults to “standing”.
#   port max_skin_blood_flow: Maximum blood flow from the core to the skin, [kg/h/m2]. Defaults to 90.
#   port max_sweating: Maximum rate at which regulatory sweat is generated, [kg/h/m2]. Defaults to 500.
#   port w_max: Maximum skin wettedness (w) adimensional. Ranges from 0 and 1. Defaults to False.
#   port e_skin: Total rate of evaporative heat loss from skin, [W/m2]. Equal to e_rsw + e_diff.
#   port e_rsw: Rate of evaporative heat loss from sweat evaporation, [W/m2].
#   port e_max: Maximum rate of evaporative heat loss from skin, [W/m2].
#   port q_sensible: Sensible heat loss from skin, [W/m2].
#   port q_skin: Total rate of heat loss from skin, [W/m2]. Equal to q_sensible + e_skin.
#   port q_res: Total rate of heat loss through respiration, [W/m2].
#   port t_core: Core temperature, [°C].
#   port t_skin: Skin temperature, [°C].
#   port m_bl: Skin blood flow, [kg/h/m2].
#   port m_rsw: Rate at which regulatory sweat is generated, [mL/h/m2].
#   port w: Skin wettedness, adimensional. Ranges from 0 to 1.
#   port w_max: Skin wettedness (w) practical upper limit, adimensional. Ranges from 0 to 1.
#   port SET: Standard Effective Temperature (SET).
#   port ET: New Effective Temperature (ET).
#   port pmv_gagge: PMV Gagge: Gagge’s version of Fanger’s Predicted Mean Vote (PMV).
#   port disc: Thermal discomfort (DISC). DISC is described numerically as: comfortable and pleasant (0), slightly uncomfortable but acceptable (1), uncomfortable and unpleasant (2), very uncomfortable (3), limited tolerance (4), and intolerable (5). The range of each category is ± 0.5 numerically.
#   port t_sens: Predicted Thermal Sensation.
# ---------- gagge_two_node_model: Python ----------
from carbonfly.pythermalcomfort.models import two_nodes_gagge

result = two_nodes_gagge(
    tdb=tdb, 
    tr=tr, 
    v=v, 
    rh=rh, 
    met=met, 
    clo=clo, 
    wme=wme or 0, 
    body_surface_area=BSA or 1.8258, 
    p_atm=p_atm or 101325, 
    position=position or "standing", 
    max_skin_blood_flow=max_skin_blood_flow or 90, 
    max_sweating=max_sweating or 500, 
    w_max=w_max or False
)

e_skin = result["e_skin"]
e_rsw = result["e_rsw"]
e_max = result["e_max"]
q_sensible = result["q_sensible"]
q_skin = result["q_skin"]
q_res = result["q_res"]
t_core = result["t_core"]
t_skin = result["t_skin"]
m_bl = result["m_bl"]
m_rsw = result["m_rsw"]
w = result["w"]
w_max = result["w_max"]
SET = result["set"]
ET = result["et"]
pmv_gagge = result["pmv_gagge"]
pmv_set = result["pmv_set"]
disc = result["disc"]
t_sens = result["t_sens"]
# ---------- end gagge_two_node_model ----------
panel_15 = Panel(gagge_two_node_model.e_skin)
panel_16 = Panel(gagge_two_node_model.e_rsw)
panel_17 = Panel(gagge_two_node_model.e_max)
panel_18 = Panel(gagge_two_node_model.q_sensible)
panel_19 = Panel(gagge_two_node_model.q_skin)
panel_20 = Panel(gagge_two_node_model.q_res)
panel_21 = Panel(gagge_two_node_model.m_bl)
panel_22 = Panel(gagge_two_node_model.m_rsw)
panel_23 = Panel(gagge_two_node_model.w)
panel_24 = Panel(gagge_two_node_model.w_max)
panel_25 = Panel(gagge_two_node_model.SET)
panel_26 = Panel(gagge_two_node_model.ET)
panel_27 = Panel(gagge_two_node_model.pmv_gagge)
panel_28 = Panel(gagge_two_node_model.pmv_set)
panel_29 = Panel(gagge_two_node_model.disc)
panel_30 = Panel(gagge_two_node_model.t_sens)
panel_31 = Panel(gagge_two_node_model.t_core)
panel_32 = Panel(gagge_two_node_model.t_skin)

pt_5 = ConstructPoint(XCoordinate=Slider(2350, range=0..3000), YCoordinate=Slider(2800, range=0..3000), ZCoordinate=0)
pi = Pi(Factor=0.5)
manikin_lod_0 = ManikinLOD0(base_point=pt_5, width=Slider(400, range=0..3000), height=Slider(990.5, range=0..3000), angle=pi)  # -> body_surface_area_2, body_2, mouth_2, breathing_u
panel_33 = Panel(manikin_lod_0.body_surface_area_2)
preview_5 = CustomPreview(Geometry=manikin_lod_0.body_2, Material=ColourSwatch(SwatchColor=RGBA(153, 153, 153, 100)))
preview_6 = CustomPreview(Geometry=manikin_lod_0.mouth_2, Material=ColourSwatch(SwatchColor=RGBA(255, 0, 0, 100)))

pt_6 = ConstructPoint(
    XCoordinate=Slider(500, range=0..3000),
    YCoordinate=Slider(550, range=0..3000),
    ZCoordinate=Slider(-3300, range=-5000..3000))
manikin_lod_0_2 = ManikinLOD0(base_point=pt_6, width=Slider(400, range=0..3000), height=Slider(1023.5, range=0..3000))  # -> body_surface_area_2, body_2, mouth_2, breathing_u
xz = XZPlane(Origin=Point(0, 0, 0))
panel_34 = Panel(manikin_lod_0_2.body_surface_area_2)
rotate = Rotate(Geometry=manikin_lod_0_2.mouth_2, Angle=1.570796327, Plane=xz)  # -> Geometry, Transform
rotate_2 = Rotate(Geometry=manikin_lod_0_2.body_2, Angle=1.570796327, Plane=xz)  # -> Geometry, Transform
preview_7 = CustomPreview(Geometry=rotate_2.Geometry, Material=ColourSwatch(SwatchColor=RGBA(76, 76, 76, 100)))
preview_8 = CustomPreview(Geometry=rotate.Geometry, Material=ColourSwatch(SwatchColor=RGBA(255, 115, 0, 100)))

# ----
# [°C] -> [K]
panel_35 = Panel("273.15")
addition = Addition(A=gagge_two_node_model_sleep.t_core, B=panel_35)
addition_2 = Addition(A=gagge_two_node_model_sleep.t_skin, B=panel_35)
panel_36 = Panel(addition)
panel_37 = Panel(addition_2)

# ----
# [°C] -> [K]
panel_38 = Panel("273.15")
addition_3 = Addition(A=gagge_two_node_model.t_core, B=panel_38)
addition_4 = Addition(A=gagge_two_node_model.t_skin, B=panel_38)
panel_39 = Panel(addition_3)
panel_40 = Panel(addition_4)

# ----
# ~ 46000 ppm
# (7.2 L/min resipiration
# & 0.0055 L/s CO2)
# ~ 46000 ppm
# (7.2 L/min resipiration
# & 0.0055 L/s CO2)
number_slider_2 = Slider(0.046, range=0.0004..0.05)
pcen = PolygonCenter(Polyline=manikin_lod_0.mouth_2)  # -> CenterV, CenterE, CenterA
pcen_2 = PolygonCenter(Polyline=rotate.Geometry)  # -> CenterV, CenterE, CenterA
pcen_3 = PolygonCenter(Polyline=move_2.Geometry)  # -> CenterV, CenterE, CenterA
neg = Negative(Value=manikin_lod_0.breathing_u)
vec = VectorXYZ(XComponent=0, YComponent=neg, ZComponent=0)  # -> Vector, Length
vdis = VectorDisplay(Anchor=pcen.CenterV, Vector=vec.Vector)
vec_2 = VectorXYZ(XComponent=0, YComponent=0, ZComponent=manikin_lod_0_2.breathing_u)  # -> Vector, Length
vdis_2 = VectorDisplay(Anchor=pcen_2.CenterV, Vector=vec_2.Vector)
vec_3 = VectorXYZ(XComponent=0, YComponent=0, ZComponent=Slider(-0.05, range=-2..2))  # -> Vector, Length
vdis_3 = VectorDisplay(Anchor=pcen_3.CenterV, Vector=vec_3.Vector)
body = CarbonflyBody(temperature=addition_4)  # -> boundary; inputs temperature: Double
#   port temperature: Skin temperature in K
#   port boundary: Body boundary
# ---------- body: Python ----------
# GH inputs:
#   temperature (Number)  # K
# GH outputs:
#   boundary

from math import isfinite
import carbonfly.boundary as cfbc

try:
    # check T input
    T = float(temperature)
    if not isfinite(T):
        raise ValueError("Temperature (T) must be a finite number (K).")

    fields = {
        "U":        cfbc.FieldNoSlip(),
        "T":        cfbc.FieldFV(T),
        "CO2":      cfbc.FieldZG(),
        "p":        cfbc.FieldZG(),
        "p_rgh":    cfbc.FieldFixedFluxPressure("$internalField"),
        "alphat":   cfbc.FieldAlphatJayatillekeWF(value="$internalField", Prt=0.85),
        "epsilon":  cfbc.FieldEpsilonWallFunction("$internalField"),
        "G":        cfbc.FieldMarshakRadiation(emissivity=0.98, value="$internalField"),
        "k":        cfbc.FieldKqRWallFunction("$internalField"),
        "nut":      cfbc.FieldNutkWallFunction("$internalField"),
        "Ydefault": cfbc.FieldFV("$internalField"),
    }

    boundary = cfbc.Boundary(
        region_name="",
        btype="wall",
        fields=fields
    )

except Exception as e:
    boundary = None
# ---------- end body ----------
panel_41 = Panel(body)
body_2 = CarbonflyBody(temperature=addition_2)  # -> boundary; inputs temperature: Double; same code as body
panel_42 = Panel(body_2)
inletvelocity = CarbonflyInletVelocity(velocity=vec.Vector, temperature=addition_3, CO2=number_slider_2)  # -> boundary; inputs velocity: Vector3d, temperature: Double, CO2: Double
#   port velocity: Inlet velocity (m/s) as a vector, e.g. (0, 0, -1).
#   port temperature: Inlet temperature in K (e.g. 293.15).
#   port CO2: Inlet CO₂ as volume fraction (e.g., 0.000450 for 450 ppm).
#   port boundary: InletVelocity boundary
# ---------- inletvelocity: Python ----------
# GH inputs: velocity (Rhino.Geometry.Vector3d), temperature (float), CO2 (float)
# GH outputs: boundary
from math import isfinite
import carbonfly.boundary as cfbc

def vec3_to_tuple(v):
    return (float(v.X), float(v.Y), float(v.Z))

try:
    # check input
    if velocity is None:
        raise ValueError("velocity is required.")
    if not isfinite(temperature):
        raise ValueError("Temperature (T) must be a finite number.")
    if not isfinite(CO2):
        raise ValueError("CO2 must be a finite number (fraction).")

    fields = {
        "U":        cfbc.FieldFV(vec3_to_tuple(velocity)),
        "T":        cfbc.FieldFV(float(temperature)),
        "CO2":      cfbc.FieldFV(float(CO2)),
        "air":      cfbc.FieldFV(1-float(CO2)),
        "p":        cfbc.FieldFV("$internalField"),
        "p_rgh":    cfbc.FieldFixedFluxPressure("$internalField"),
        "alphat":   cfbc.FieldCalculated("$internalField"),
        "epsilon":  cfbc.FieldMixingLengthEpsilonInlet(value="$internalField", mixingLength=0.0168),
        "G":        cfbc.FieldMarshakRadiation(emissivity=0.98, value="$internalField"),
        "k":        cfbc.FieldIntensityKInlet(intensity=0.14, value="$internalField"),
        "nut":      cfbc.FieldCalculated("$internalField"),
        "Ydefault": cfbc.FieldFV("$internalField"),
    }

    boundary = cfbc.Boundary(
        region_name="",
        btype="inletVelocity",
        fields=fields
    )

except Exception as e:
    boundary = None
# ---------- end inletvelocity ----------
panel_43 = Panel(inletvelocity)
wall = CarbonflyWall(temperature=Slider(295.15, range=273.15..300))  # -> boundary; inputs temperature: Double; same code as body
panel_44 = Panel(wall)
inletvelocity_2 = CarbonflyInletVelocity(velocity=vec_2.Vector, temperature=addition, CO2=Slider(0.046, range=0.0004..0.05))  # -> boundary; inputs velocity: Vector3d, temperature: Double, CO2: Double; same code as inletvelocity
panel_45 = Panel(inletvelocity_2)
inletvelocity_3 = CarbonflyInletVelocity(velocity=vec_3.Vector, temperature=Slider(293.15, range=273.15..300), CO2=Slider(0.0004, range=0.0004..0.001))  # -> boundary; inputs velocity: Vector3d, temperature: Double, CO2: Double; same code as inletvelocity
panel_46 = Panel(inletvelocity_3)
outlet = CarbonflyOutlet()  # -> boundary
#   port boundary: Outlet boundary
# ---------- outlet: Python ----------
# GH outputs:
#   boundary

import carbonfly.boundary as cfbc

try:
    fields = {
        "U":        cfbc.FieldZG(),
        "T":        cfbc.FieldZG(),
        "CO2":      cfbc.FieldZG(),
        "p":        cfbc.FieldZG(),
        "p_rgh":    cfbc.FieldFV("$internalField"),
        "alphat":   cfbc.FieldZG(),
        "epsilon":  cfbc.FieldZG(),
        "G":        cfbc.FieldZG(),
        "k":        cfbc.FieldZG(),
        "nut":      cfbc.FieldZG(),
        "Ydefault": cfbc.FieldFV("$internalField"),
    }

    boundary = cfbc.Boundary(
        region_name="",
        btype="zeroGradientOutlet",
        fields=fields
    )
except Exception as e:
    boundary = None
# ---------- end outlet ----------
panel_47 = Panel(outlet)
createcfgeometry = CreateCarbonflyGeometry(name="standing_body", geometry=flatten(manikin_lod_0.body_2), boundary=body, refine_levels="(5,7)")  # -> log, CF_geo; inputs name: String, geometry: list of GeometryBase, boundary: list, refine_levels: Interval
#   port name: Region/solid name for STL & regions{}.
#   port geometry: Single surface/face/brep or a collection
#   port boundary: Carbonfly boundary
#   port refine_levels: Refine levels for meshing: (min, max) or as a single float number
#   port CF_geo: Carbonfly Geometry
# ---------- createcfgeometry: Python ----------
# GH inputs:
#   name (str), 
#   geometry (list + flatten), 
#   boundary (carbonfly boundary or list), 
#   refine_levels (interval or list)
# GH outputs:
#   CF_geo, log

import carbonfly.geo as cfgeo

def as_list(x):
    return x if isinstance(x, (list, tuple)) else [x]

def broadcast_to_len(lst, n, fallback=None):
    """If length==1 -> broadcast to n; if length==0 -> use fallback (then broadcast); else length must equal n."""
    if lst is None:
        lst = [] if fallback is None else [fallback]
    if len(lst) == 0:
        lst = [] if fallback is None else [fallback]
    if len(lst) == 1 and n > 1:
        return lst * n
    return lst

CF_geo = []
logs = []
try:
    geos = as_list(geometry)
    if not geos:
        raise ValueError("Geometry list is empty. Please connect a flattened Surface/BrepFace/Brep list.")

    N = len(geos)

    # name
    if not isinstance(name, str) or not name.strip():
        raise ValueError("Input 'name' must be a single non-empty string.")
    region_name = name.strip()
    names = [region_name] * N   # broadcast the same name to all geometries

    # boundary
    bnds = as_list(boundary) if boundary is not None else []
    bnds = broadcast_to_len(bnds, N, fallback=None)
    if len(bnds) != N:
        raise ValueError(f"The number of boundaries ({len(bnds)}) does not match the number of geometries ({N}) and cannot be broadcast.")

    # refine_levels
    refs = as_list(refine_levels) if refine_levels is not None else []
    refs = broadcast_to_len(refs, N, fallback=None)
    if len(refs) != N:
        raise ValueError(f"The number of refine_levels ({len(refs)}) does not match the number of geometries ({N}) and cannot be broadcast.")

    # build CFGeo items
    for i in range(N):
        cg = cfgeo.make_cfgeo(names[i], geos[i], bnds[i], refs[i])
        CF_geo.append(cg)

    logs.append(f"CF_geo created: {len(CF_geo)} item(s):\n{CF_geo[0].name} -> refine=({CF_geo[0].refine.min_level}, {CF_geo[0].refine.max_level})")
    log = "\n".join(logs)

except Exception as e:
    CF_geo = []
    log = f"[Error] {e}"
# ---------- end createcfgeometry ----------
createcfgeometry_2 = CreateCarbonflyGeometry(name="sleeping_body", geometry=flatten(rotate_2.Geometry), boundary=body_2, refine_levels="(5,7)")  # -> log, CF_geo; inputs name: String, geometry: list of GeometryBase, boundary: list, refine_levels: Interval; same code as createcfgeometry
createcfgeometry_3 = CreateCarbonflyGeometry(name="standing_mouth", geometry=flatten(manikin_lod_0.mouth_2), boundary=inletvelocity, refine_levels="(6,8)")  # -> log, CF_geo; inputs name: String, geometry: list of GeometryBase, boundary: list, refine_levels: Interval; same code as createcfgeometry
createcfgeometry_4 = CreateCarbonflyGeometry(name="outlet", geometry=flatten(move_3.Geometry), boundary=outlet, refine_levels="(3,5)")  # -> log, CF_geo; inputs name: String, geometry: list of GeometryBase, boundary: list, refine_levels: Interval; same code as createcfgeometry
createcfgeometry_5 = CreateCarbonflyGeometry(name="sleeping_mouth", geometry=flatten(rotate.Geometry), boundary=inletvelocity_2, refine_levels="(6,8)")  # -> log, CF_geo; inputs name: String, geometry: list of GeometryBase, boundary: list, refine_levels: Interval; same code as createcfgeometry
createcfgeometry_6 = CreateCarbonflyGeometry(name="inlet", geometry=flatten(move_2.Geometry), boundary=inletvelocity_3, refine_levels="(3,5)")  # -> log, CF_geo; inputs name: String, geometry: list of GeometryBase, boundary: list, refine_levels: Interval; same code as createcfgeometry
createcfgeometry_7 = CreateCarbonflyGeometry(name="wall", geometry=flatten([item_6, item, item_2, item_3, sdiff, item_5]), boundary=wall, refine_levels="(2,4)")  # -> log, CF_geo; inputs name: String, geometry: list of GeometryBase, boundary: list, refine_levels: Interval; same code as createcfgeometry
panel_48 = Panel(createcfgeometry.CF_geo)
panel_49 = Panel(createcfgeometry.log)
panel_50 = Panel(createcfgeometry_2.CF_geo)
panel_51 = Panel(createcfgeometry_2.log)
panel_52 = Panel(createcfgeometry_3.CF_geo)
panel_53 = Panel(createcfgeometry_3.log)
panel_54 = Panel(createcfgeometry_4.CF_geo)
panel_55 = Panel(createcfgeometry_7.CF_geo)
panel_56 = Panel(createcfgeometry_5.CF_geo)
panel_57 = Panel(createcfgeometry_5.log)
panel_58 = Panel(createcfgeometry_7.log)
panel_59 = Panel(createcfgeometry_6.CF_geo)
panel_60 = Panel(createcfgeometry_4.log)
panel_61 = Panel(createcfgeometry_6.log)

vec_4 = VectorXYZ(XComponent=0, YComponent=0, ZComponent=0)  # -> Vector, Length
internalfields = CarbonflyInternalFields(U_internal=vec_4.Vector, T_internal="300", CO2_internal="0.001000", p_internal="101325")  # -> log, internalFields; inputs U_internal: Vector3d, T_internal: Double, CO2_internal: Double, p_internal: Double
#   port U_internal: internalFields for U
#   port T_internal: internalFields for air temperature
#   port CO2_internal: internalFields for CO₂ concentration, as volume fraction (e.g., 0.000450 for 450 ppm).
#   port p_internal: internalFields for pressure
#   port internalFields: Carbonfly internalFields
# ---------- internalfields: Python ----------
# GH inputs:
#   U_internal (Vector)    # optional, m/s
#   T_internal (Number)    # optional, K
#   CO2_internal (Number)  # optional, volume fraction (e.g. 0.00045)
#   p_internal (Number)    # optional, Pa
# GH outputs:
#   log
#   internalFields

from math import isfinite
import json

def _vec3_or_none(v):
    if v is None:
        return None
    try:
        return (float(v.X), float(v.Y), float(v.Z))
    except Exception:
        raise ValueError("U_internal must be a Rhino Vector (X,Y,Z).")

def _finite_or_none(x, label):
    if x is None:
        return None
    try:
        val = float(x)
    except Exception:
        raise ValueError("{} must be a number.".format(label))
    if not isfinite(val):
        raise ValueError("{} must be finite.".format(label))
    return val

logs = []
try:
    Ui = _vec3_or_none(U_internal)
    Ti = _finite_or_none(T_internal, "T_internal")
    Ci = _finite_or_none(CO2_internal, "CO2_internal")
    Pi = _finite_or_none(p_internal, "p_internal")

    internalFields = {
        "U":        Ui,
        "T":        Ti,
        "CO2":      Ci,
        "p":        Pi,
        "p_rgh":    0,
        "alphat":   0,
        "epsilon":  0.01,
        "G":        0,
        "k":        0.1,
        "nut":      0,
        "Ydefault": 0,
    }
    internalFields = json.dumps(internalFields)

    # Brief log
    logs.append("[internalFields] packaged:")
    logs.append("  U:   {} m/s".format(Ui if Ui is not None else "None"))
    logs.append("  T:   {} K".format(Ti if Ti is not None else "None"))
    logs.append("  CO2: {} ppm".format(Ci*1e6 if Ci is not None else "None"))
    logs.append("  p:   {} hPa".format(Pi/100 if Pi is not None else "None"))
    logs.append("  ...")

    log = "\n".join(logs)

except Exception as e:
    internalFields = None
    log = "[Error] {}".format(e)
# ---------- end internalfields ----------
panel_62 = Panel(internalfields.log)
panel_63 = Panel(internalfields.internalFields)

merge = Merge(
    Data1=createcfgeometry.CF_geo,
    Data2=createcfgeometry_3.CF_geo,
    Data3=createcfgeometry_2.CF_geo,
    Data4=createcfgeometry_5.CF_geo,
    Data5=createcfgeometry_7.CF_geo,
    Data6=createcfgeometry_6.CF_geo,
    Data7=createcfgeometry_4.CF_geo)

controldict = CarbonflyControlDict(mode="transient", writeInterval="5", endTime="600")  # -> log, controlDict; inputs mode: String, writeInterval: Double, endTime: Double
#   port mode: Simulation mode: transient or steady-state
#   port endTime: Simulation end time, in seconds (transient) / iterations (steady-state)
#   port controlDict: Carbonfly controlDict
# ---------- controldict: Python ----------
# GH inputs:
#   mode (Text)      # "steady" or "transient"
#   endTime (Number) # transient: seconds; steady: iterations
# GH outputs:
#   controlDict (Text)
#   log (Text)

import json
import importlib
import carbonfly.control_dict as cfdict
importlib.reload(cfdict)

def _norm_mode(m):
    m = (m or "transient").strip().lower()
    return "steady" if m in ("steady", "steady-state", "steadystate") else "transient"

def _norm_endtime(val, is_transient):
    # transient -> float seconds / steady state -> int interations
    if val is None:
        return 120.0 if is_transient else 1000
    try:
        v = float(val)
    except:
        return 120.0 if is_transient else 1000
    return float(v) if is_transient else max(1, int(round(v)))

logs = []
try:
    mode_norm = _norm_mode(mode)
    is_transient = (mode_norm == "transient")
    et = _norm_endtime(endTime, is_transient)

    if is_transient:
        base = cfdict.make_default("transient", application="buoyantReactingFoam")
        base["endTime"] = float(et)   # seconds
    else:
        base = cfdict.make_default("steady", application="buoyantReactingFoam")
        base["endTime"] = int(et)     # iterations

    if writeInterval is not None:
        base["writeInterval"] = float(writeInterval)

    controlDict = json.dumps(base, ensure_ascii=False, indent=2)
    logs.append(f"[ok] controlDict configured. mode={mode_norm}, endTime={et}, writeInterval={writeInterval}, app={base.get('application')}")
    log = "\n".join(logs)

except Exception as e:
    controlDict = ""
    log = f"[Error] {e}"
# ---------- end controldict ----------
fvsolution = CarbonflyFvSolution(mode="transient")  # -> fvSolution_path; inputs mode: String
#   port mode: Simulation mode: transient or steady-state
#   port fvSolution_path: fvSolution template path
# ---------- fvsolution: Python ----------
# GH inputs:
#   mode (Text)      # "steady" or "transient"
# GH outputs:
#   fvSolution_path (Text)   # path of fvSolution template
from carbonfly.fv_writer import get_template_path

norm = str(mode) if mode else "transient"
fvSolution_path = str(get_template_path("fvSolution", norm))
# ---------- end fvsolution ----------
fvschemes = CarbonflyFvSchemes(mode="transient")  # -> fvSchemes_path; inputs mode: String
#   port mode: Simulation mode: transient or steady-state
#   port fvSchemes_path: fvSchemes template path
# ---------- fvschemes: Python ----------
# GH inputs:
#   mode (Text)      # "steady" or "transient"
# GH outputs:
#   fvSchemes_path (Text)   # path of fvSchemes template
import sys, os
from pathlib import Path

from carbonfly.fv_writer import get_template_path

norm = str(mode) if mode else "transient"
p = get_template_path("fvSchemes", norm)
fvSchemes_path = str(p)
# ---------- end fvschemes ----------
panel_64 = Panel(controldict.controlDict)
panel_65 = Panel(controldict.log)
panel_66 = Panel(fvsolution)
panel_67 = Panel(fvschemes)

# ----
# 5. Generate carbonfly case
# Click here to run!
number_slider_3 = Slider(1500, range=0..5000)
pt_7 = ConstructPoint(XCoordinate=Slider(597, range=0..5000), YCoordinate=Slider(1500, range=0..5000), ZCoordinate=number_slider_3)
residual_control = CarbonflyResidualControlList({"1e-4", "1e-5", "1e-6"}, selected="1e-5")
run = BooleanToggle(False)
createcfcase = CreateCarbonflyCase(
    case_dir="C:\Data\Carbonfly",
    case_name="04_thermal_comfort_Gagge_two_node_model",
    CF_geo=merge,
    unit="mm",
    controlDict=controldict.controlDict,
    fvSchemes_path=fvschemes,
    fvSolution_path=fvsolution,
    residual=residual_control,
    insidePoint=pt_7,
    internalFields=internalfields.internalFields,
    run=run)  # -> log, case_path; inputs case_dir: String, case_name: String, CF_geo: list, unit: String, fvSchemes_path: String, fvSolution_path: String, insidePoint: Point3d, run: Boolean
#   port case_dir: OpenFOAM case root folder (creates 0/, system/, constant/triSurface/, etc.).
#   port case_name: Carbonfly case name
#   port CF_geo: List of Carbonfly Geometry objects (from CreateCFGeometry).
#   port unit: "mm" (default), "cm", "m" -> scaled to meters on export.
#   port controlDict: Carbonfly controlDict
#   port fvSchemes_path: fvSchemes template path
#   port fvSolution_path: fvSolution template path
#   port residual: Residual control, e.g. 1e-5
#   port insidePoint: A reference point inside the mesh/room
#   port internalFields: Carbonfly internalFields
#   port run: When True, create Carbonfly case
#   port case_path: Carbonfly case path
# ---------- createcfcase: Python ----------
# GH inputs:
#   case_dir (Text)
#   case_name (Text)
#   CF_geo (List)
#   unit (Text)     # optional, m / cm / mm
#   controlDict
#   fvSchemes_path
#   fvSolution_path
#   residual
#   insidePoint     # optional, reference point inside mesh
#   internalFields
#   run (Boolean)
# GH outputs:
#   log (Text)
#   case_path (Text)

import re
import json
from collections.abc import Sequence
from pathlib import Path
import carbonfly.case as cfcase
import carbonfly.control_dict as cfdict
from carbonfly.utils import unit_scale_to_m
from carbonfly.fv_writer import copy_fv_templates_to_case, patch_fvSolution_pimple

def _safe_name(s):
    s = (s or "unnamed").strip()
    s = re.sub(r"[^\w\-]+", "_", s)
    return s or "unnamed"

def _norm_unit(u):
    u = (u or "mm").strip().lower()
    if u not in ("mm", "cm", "m"):
        raise ValueError("unit must be 'mm', 'cm', or 'm'")
    return u

def _norm_path(p):
    if not p:
        return None
    s = str(p).strip()
    return Path(s) if s else None


def _norm_residual(v):
    if v is None:
        return None
    if isinstance(v, (int, float)):
        return float(v)
    s = str(v).strip()
    if s == "":
        return None
    return float(s)

def _parse_inside_point(p):
    """
    Accepts: Rhino Point3d / Vector3d / GH_Point(.Value) / [x, y, z] / (possibly [point]).
    Returns (x, y, z) or None if not parseable.
    """
    if p is None:
        return None

    # Unwrap singletons like [point]
    if isinstance(p, (list, tuple)) and len(p) == 1:
        p = p[0]

    # RhinoCommon Point3d / Vector3d or any object with X/Y/Z attrs
    if hasattr(p, "X") and hasattr(p, "Y") and hasattr(p, "Z"):
        try:
            return (float(p.X), float(p.Y), float(p.Z))
        except Exception:
            pass

    v = getattr(p, "Value", None) or getattr(p, "Location", None)
    if v is not None and hasattr(v, "X") and hasattr(v, "Y") and hasattr(v, "Z"):
        try:
            return (float(v.X), float(v.Y), float(v.Z))
        except Exception:
            pass

    # Generic sequence [x, y, z]
    if isinstance(p, Sequence) and not isinstance(p, (str, bytes)):
        if len(p) >= 3:
            try:
                return (float(p[0]), float(p[1]), float(p[2]))
            except Exception:
                pass

    return None

logs = []
try:
    # validations
    if not case_dir or not str(case_dir).strip():
        raise ValueError("case_dir is required.")
    if not CF_geo or len(CF_geo) == 0:
        raise ValueError("CF_geo is empty, please connect the output from CreateCFGeometry.")

    base_dir   = Path(str(case_dir)).expanduser()
    folder     = _safe_name(case_name)
    target_dir = base_dir / folder
    case_path  = str(target_dir)

    stl_name = "model.stl"
    unit_in  = _norm_unit(unit)
    scale_to_m = unit_scale_to_m(unit_in)

    # blockMesh settings
    pad_m = 1.0
    cell_m = 0.25

    # insidePoint
    inside_pt_model = _parse_inside_point(insidePoint)  # in model units
    inside_pt = tuple(c * scale_to_m for c in inside_pt_model) if inside_pt_model else None

    # default internalFields if not given
    U_internal      = [0.0, 0.0, 0.0]
    T_internal      = 295.15
    CO2_internal    = 0.000400
    P_internal      = 100_000.0
    P_rgh_internal  = 0
    alphat_internal = 0
    epsilon_internal= 0.01
    G_internal      = 0
    k_internal      = 0.1
    nut_internal    = 0
    Ydefault_internal   = 0

    fields = None
    if internalFields:
        fields = json.loads(internalFields)
                        
    if isinstance(fields, dict):
        U_internal      = fields.get("U",   U_internal)
        T_internal      = fields.get("T",   T_internal)
        CO2_internal    = fields.get("CO2", CO2_internal)
        P_internal      = fields.get("p",   P_internal)
        P_rgh_internal  = fields.get("p_rgh",   P_rgh_internal)
        alphat_internal = fields.get("alphat",   alphat_internal)
        epsilon_internal= fields.get("epsilon",   epsilon_internal)
        G_internal      = fields.get("G",   G_internal)
        k_internal      = fields.get("k",   k_internal)
        nut_internal    = fields.get("nut",   nut_internal)
        Ydefault_internal   = fields.get("Ydefault",   Ydefault_internal)

    # unpack controlDict
    cdict_json = None
    if controlDict:
        cdict_json = json.loads(controlDict)

    # fvSchemes & fvSolution
    fvSchemes_src = _norm_path(fvSchemes_path)
    fvSolution_src = _norm_path(fvSolution_path)

    # PIMPLE settings
    rv = _norm_residual(residual)

    if not run:
        # dry-run: no filesystem writes
        logs.append(f"Case will be created at: {target_dir}")
        logs.append(f"STL file: {stl_name}, unit: {unit_in}")
        logs.append(f"CF_geo count: {len(CF_geo)}")
        logs.append(f"blockMesh: padding_m={pad_m}, cell_size_m={cell_m}")
        logs.append("U_internal: " + (f"{U_internal} m/s" if U_internal else "None"))
        logs.append("T_internal: " + (f"{T_internal} K" if (T_internal is not None) else "None"))
        logs.append("CO2_internal: " + (f"{CO2_internal*1e6} ppm" if (CO2_internal is not None) else "None"))
        logs.append("P_internal: " + (f"{P_internal} Pa" if (P_internal is not None) else "None"))

        logs.append("P_rgh_internal: " + (f"{P_rgh_internal}" if (P_rgh_internal is not None) else "None"))
        logs.append("alphat_internal: " + (f"{alphat_internal}" if (alphat_internal is not None) else "None"))
        logs.append("epsilon_internal: " + (f"{epsilon_internal}" if (epsilon_internal is not None) else "None"))
        logs.append("G_internal: " + (f"{G_internal}" if (G_internal is not None) else "None"))
        logs.append("k_internal: " + (f"{k_internal}" if (k_internal is not None) else "None"))
        logs.append("nut_internal: " + (f"{nut_internal}" if (nut_internal is not None) else "None"))
        logs.append("Ydefault_internal: " + (f"{Ydefault_internal}" if (Ydefault_internal is not None) else "None"))
        if inside_pt is not None:
            logs.append(f"insidePoint (model units): {inside_pt_model}")
        else:
            logs.append("insidePoint: Default (Warning: may cause error))")
        if fvSchemes_src:
            logs.append(f"fvSchemes template: {fvSchemes_src}")
        else:
            logs.append("fvSchemes template not provided")
        if fvSolution_src:
            logs.append(f"fvSolution template: {fvSolution_src}")
        else:
            logs.append("fvSolution template not provided")
        logs.append(f"Residual: {rv if rv is not None else '(not provided)'}")

        logs.append("\n=== Click RUN to generate files ===")
        log = "\n".join(logs)
    else:
        # real writes
        logs.append(f"[Run] Creating case at: {target_dir}")
        # build case
        lgs, paths = cfcase.build_case(
            case_root=target_dir,
            cfgeos=CF_geo,
            stl_file_name=stl_name,
            unit=unit_in,
            internal_U=U_internal,
            internal_T=T_internal,
            internal_CO2=CO2_internal,
            internal_P=P_internal,
            internal_P_rgh=P_rgh_internal,
            internal_alphat=alphat_internal,
            internal_epsilon=epsilon_internal,
            internal_k=k_internal,
            internal_nut=nut_internal,
            internal_G=G_internal,
            internal_Ydefault=Ydefault_internal,
            write_blockmesh=True,
            padding_m=pad_m,
            cell_size_m=cell_m,
            write_snappy=True,
            inside_point=inside_pt,
            write_constant=True,
            write_fv=True,
            fvSchemes_path=fvSchemes_src,
            fvSolution_path=fvSolution_src
        )
        
        # controDict
        if cdict_json:
            cpath = cfdict.write_control_dict_from_json(target_dir, json.dumps(cdict_json))
            logs.append(f"controlDict written: {cpath}")
        
        # patch PIMPLE settings in fvSolution
        patched_path = patch_fvSolution_pimple(
            fvsolution_path=paths["fvSolution"],
            pRefPoint=inside_pt,
            residual_value=rv
        )
        logs.append(f"fvSolution patched: {patched_path}")

        # summary
        logs.append("\n==== summary ====\n")
        if 'stl' in paths:       logs.append(f"STL:               {paths.get('stl')}")
        if 'blockMesh' in paths: logs.append(f"blockMeshDict:     {paths.get('blockMesh')}")
        if 'snappy' in paths:    logs.append(f"snappyHexMeshDict: {paths.get('snappy')}")
        if 'U' in paths:         logs.append(f"0/U:               {paths['U']}")
        if 'T' in paths:         logs.append(f"0/T:               {paths['T']}")
        if 'CO2' in paths:       logs.append(f"0/CO2:             {paths['CO2']}")
        if 'p' in paths:         logs.append(f"0/p:               {paths['p']}")
        if 'p_rgh' in paths:     logs.append(f"0/p_rgh:           {paths['p_rgh']}")
        if 'alphat' in paths:    logs.append(f"0/alphat:          {paths['alphat']}")
        if 'epsilon' in paths:   logs.append(f"0/epsilon:         {paths['epsilon']}")
        if 'k' in paths:         logs.append(f"0/k:               {paths['k']}")
        if 'nut' in paths:       logs.append(f"0/nut:             {paths['nut']}")
        if 'G' in paths:         logs.append(f"0/G:               {paths['G']}")
        if 'Ydefault' in paths:  logs.append(f"0/Ydefault:        {paths['Ydefault']}")

        if inside_pt is not None:
            logs.append(f"insidePoint used: {inside_pt}")
        if 'fvSchemes' in paths:  logs.append(f"fvSchemes:         {paths['fvSchemes']}")
        if 'fvSolution' in paths: logs.append(f"fvSolution:         {paths['fvSolution']}")
        logs += lgs
        log = "\n".join(logs)

except Exception as e:
    case_path = ""
    log = f"[Error] {e}"
# ---------- end createcfcase ----------
panel_68 = Panel(createcfcase.log)
panel_69 = Panel(createcfcase.case_path)

# ----
# Step 1 - blockMesh:
# creates a simple background mesh from block definitions
# 6. Run simulation
# Click here to run!
run_2 = BooleanToggle(False)
blockmesh = CarbonflyBlockMesh(case_path=createcfcase.case_path, distro="Ubuntu-20.04", run=run_2)  # -> log; inputs case_path: String, distro: String, foam_bashrc: String, run: Boolean
#   port case_path: Carbonfly case path
#   port distro: Name of the WSL distribution/profile to run the command in (e.g., “Ubuntu-22.04”); leave blank to use your default WSL.
#   port foam_bashrc: Path to the OpenFOAM bashrc file to source before running the command (e.g., “/opt/openfoam10/etc/bashrc”); leave blank to skip sourcing/use the current environment.
#   port run: When True, run blockMesh
# ---------- blockmesh: Python ----------
# GH inputs:
#   case_path (Text)
#   run (Boolean)
#   distro (Text)          # optional, e.g. "Ubuntu-22.04"
#   foam_bashrc (Text)     # optional, e.g. "/opt/openfoam10/etc/bashrc"
# GH outputs:
#   log (Text)

from pathlib import Path
import carbonfly.wsl as cfwsl

if run and case_path:
    rc = cfwsl.run_blockmesh_console(
        Path(case_path),
        distro=distro or None,
        foam_bashrc=(foam_bashrc or "/opt/openfoam10/etc/bashrc"),
    )
    log = "blockMesh finished with return code {}\n".format(rc)
    log += "[OK] Please check the console opened."
else:
    log = "=== Click RUN to open console and run blockMesh ==="
# ---------- end blockmesh ----------
panel_70 = Panel(blockmesh)

# ----
# Step 3 - snappyHexMesh:
# generates a body-fitted mesh around geometry by refining and snapping cells
# Click here to run!
run_3 = BooleanToggle(False)
snappyhexmesh = CarbonflySnappyHexMesh(case_path=createcfcase.case_path, distro="Ubuntu-20.04", run=run_3)  # -> log; inputs case_path: String, distro: String, foam_bashrc: String, run: Boolean
#   port case_path: Carbonfly case path
#   port distro: Name of the WSL distribution/profile to run the command in (e.g., “Ubuntu-22.04”); leave blank to use your default WSL.
#   port foam_bashrc: Path to the OpenFOAM bashrc file to source before running the command (e.g., “/opt/openfoam10/etc/bashrc”); leave blank to skip sourcing/use the current environment.
#   port run: When True, run snappyHexMesh
# ---------- snappyhexmesh: Python ----------
# GH inputs:
#   case_path (Text)
#   run (Boolean)
# GH outputs:
#   log (Text)

from pathlib import Path

from carbonfly.wsl import run_snappy_console

def _win_to_wsl_path(p: str) -> str:
    """Convert a Windows path to a WSL path (/mnt/<drive>/...). Minimal but sufficient here."""
    p = str(p).replace("\\", "/")
    if len(p) >= 2 and p[1] == ":":
        return f"/mnt/{p[0].lower()}/{p[2:]}"
    return p

logs = []
try:
    # Validate inputs
    if not case_path or not str(case_path).strip():
        raise ValueError("case_path is required (full path to the case folder).")

    case_dir = Path(str(case_path)).expanduser()
    dict_file = case_dir / "system" / "snappyHexMeshDict"
    emesh_file = case_dir / "constant" / "triSurface" / "model.eMesh"

    # Basic preflight info
    logs.append(f"Case: {case_dir}")
    logs.append(f"snappyHexMeshDict: {dict_file}")
    logs.append(f"eMesh: {emesh_file}")

    # Existence checks
    dict_exists = dict_file.is_file()
    emesh_exists = emesh_file.is_file()

    if not run:
        # Dry-run: do not execute
        if dict_exists:
            logs.append("[Check] snappyHexMeshDict found.")
        else:
            logs.append("[Check] snappyHexMeshDict NOT found (run CreateCFCase first).")

        if emesh_exists:
            logs.append("[Check] eMesh found.")
        else:
            logs.append("[Check] eMesh NOT found. Run the surfaceFeatures component first.")

        logs.append("")
        logs.append("This component will execute:  snappyHexMesh -overwrite")
        logs.append("\n=== Click RUN to start snappyHexMesh ===")
        log = "\n".join(str(x) for x in logs)

    else:
        # On run: enforce required files
        if not dict_exists:
            raise FileNotFoundError("system/snappyHexMeshDict not found. Generate the case first.")
        if not emesh_exists:
            raise FileNotFoundError("constant/triSurface/model.eMesh not found. Run surfaceFeatures first.")

        logs.append("")
        logs.append("[Run] Launching snappyHexMesh -overwrite ...")

        rc = run_snappy_console(
            case_root=case_dir,
            foam_bashrc=(foam_bashrc or "/opt/openfoam10/etc/bashrc"),
            distro=distro or None,
        )

        if rc == 0:
            logs.append("[OK] Please check the console opened.")
            logs.append("Check constant/polyMesh and logs under 'system/'.")
        else:
            logs.append(f"[Warning] snappyHexMesh exited with return code: {rc}")
            logs.append("Please review the console output and OpenFOAM logs for details.")

        log = "\n".join(str(x) for x in logs)

except Exception as e:
    log = f"[Error] {e}"
# ---------- end snappyhexmesh ----------
panel_71 = Panel(snappyhexmesh)

# ----
# Step 2 - surfaceFeatures:
# extracts sharp edges/features from surface geometry
# Click here to run!
run_4 = BooleanToggle(False)
surfacefeatures = CarbonflySurfaceFeatures(case_path=createcfcase.case_path, distro="Ubuntu-20.04", run=run_4)  # -> log; inputs case_path: String, distro: String, foam_bashrc: String, run: Boolean
#   port case_path: Carbonfly case path
#   port distro: Name of the WSL distribution/profile to run the command in (e.g., “Ubuntu-22.04”); leave blank to use your default WSL.
#   port foam_bashrc: Path to the OpenFOAM bashrc file to source before running the command (e.g., “/opt/openfoam10/etc/bashrc”); leave blank to skip sourcing/use the current environment.
#   port includedAngleDeg: includedAngleDeg for surfaceFeatures, default: 150 degree
#   port run: When True, run surfaceFeatures
# ---------- surfacefeatures: Python ----------
# GH inputs:
#   case_path (Text)          # full path including the case folder
#   includedAngleDeg (Number) # optional, default 150
#   run (Boolean)
# GH outputs:
#   log (Text)

from pathlib import Path

# Library APIs
from carbonfly.snappy_writer import write_surface_features_dict
from carbonfly.wsl import run_surface_features_console

def _win_to_wsl_path(p: str) -> str:
    """Convert a Windows path to a WSL path (/mnt/<drive>/...). Minimal but sufficient here."""
    p = str(p).replace("\\", "/")
    if len(p) >= 2 and p[1] == ":":
        return f"/mnt/{p[0].lower()}/{p[2:]}"
    return p

logs = []
try:
    if not case_path or not str(case_path).strip():
        raise ValueError("case_path is required (full path including the case folder).")

    target_dir = Path(str(case_path)).expanduser()
    stl_name   = "model.stl"  # fixed name
    angle      = float(includedAngleDeg) if (includedAngleDeg is not None) else 150.0

    dict_file   = target_dir / "system" / "surfaceFeaturesDict"
    emesh_file  = target_dir / "constant" / "triSurface" / "model.eMesh"

    if not run:
        # Dry-run: nothing written, just tell the user what will happen.
        logs.append("surfaceFeaturesDict will be created:")
        logs.append(f"  {dict_file}")
        logs.append(f"STL file: {stl_name}")
        logs.append(f"includedAngle: {angle:.0f} deg")
        logs.append("After that, the component will run `surfaceFeatures` to create the eMesh:")
        logs.append(f"  {emesh_file}")
        logs.append("")
        logs.append("=== Click RUN to write the dict and execute surfaceFeatures ===")
        log = "\n".join(str(x) for x in logs)

    else:
        # 1) Write system/surfaceFeaturesDict
        target_dir.mkdir(parents=True, exist_ok=True)
        out_path = write_surface_features_dict(
            case_root=target_dir,
            stl_file_name=stl_name,
            included_angle_deg=angle
        )
        logs.append("[OK] surfaceFeaturesDict written:")
        logs.append(f"  {out_path}")

        # 2) Run surfaceFeatures in a real console via WSL
        logs.append("")
        logs.append("[Run] Executing `surfaceFeatures` to generate the eMesh...")
        
        rc = run_surface_features_console(
            case_root=target_dir,
            foam_bashrc=(foam_bashrc or "/opt/openfoam10/etc/bashrc"),
            distro=distro or None,
        )
        
        if rc == 0:
            logs.append("[OK] Please check the console opened.")
            logs.append(f"eMesh created at (expected):")
            logs.append(f"  {emesh_file}")
        else:
            logs.append(f"[Warning] surfaceFeatures exited with return code: {rc}")
            logs.append("Please check the console output and any OpenFOAM logs for details.")

        log = "\n".join(str(x) for x in logs)

except Exception as e:
    log = f"[Error] {e}"
# ---------- end surfacefeatures ----------
panel_72 = Panel(surfacefeatures)

# ----
# Step 4 - checkMesh:
# checks mesh quality (non-orthogonality, skewness, aspect ratio, etc.)
# Click here to run!
run_5 = BooleanToggle(False)
checkmesh = CarbonflyCheckMesh(case_path=createcfcase.case_path, distro="Ubuntu-20.04", run=run_5)  # -> log; inputs case_path: String, distro: String, foam_bashrc: String, run: Boolean
#   port case_path: Carbonfly case path
#   port distro: Name of the WSL distribution/profile to run the command in (e.g., “Ubuntu-22.04”); leave blank to use your default WSL.
#   port foam_bashrc: Path to the OpenFOAM bashrc file to source before running the command (e.g., “/opt/openfoam10/etc/bashrc”); leave blank to skip sourcing/use the current environment.
#   port run: When True, run checkMesh
# ---------- checkmesh: Python ----------
# GH inputs:
#   case_path (Text)   # full path to the case folder
#   run (Boolean)
# GH outputs:
#   log (Text)

from pathlib import Path

from carbonfly.wsl import run_check_mesh_console

def _win_to_wsl_path(p: str) -> str:
    """Convert a Windows path to a WSL path (/mnt/<drive>/...). Minimal but sufficient here."""
    p = str(p).replace("\\", "/")
    if len(p) >= 2 and p[1] == ":":
        return f"/mnt/{p[0].lower()}/{p[2:]}"
    return p

logs = []
try:
    # Validate inputs
    if not case_path or not str(case_path).strip():
        raise ValueError("case_path is required (full path to the case folder).")

    case_dir = Path(str(case_path)).expanduser()

    if not run:
        # Dry-run: do not execute
        logs.append("This component will execute:  checkMesh")
        logs.append("\n=== Click RUN to start checkMesh ===")
        log = "\n".join(str(x) for x in logs)

    else:
        # On run: enforce required files
        logs.append("")
        logs.append("[Run] Launching checkMesh ...")

        rc = run_check_mesh_console(
            case_root=case_dir,
            foam_bashrc=(foam_bashrc or "/opt/openfoam10/etc/bashrc"),
            distro=distro or None,
        )

        if rc == 0:
            logs.append("[OK] Please check the console opened.")
        else:
            logs.append(f"[Warning] checkMesh exited with return code: {rc}")
            logs.append("Please review the console output and OpenFOAM logs for details.")

        log = "\n".join(str(x) for x in logs)

except Exception as e:
    log = f"[Error] {e}"
# ---------- end checkmesh ----------
panel_73 = Panel(checkmesh)

# ----
# Step 5 - runFoam
# run OpenFOAM solver for simulation
# Click here to run!
run_6 = BooleanToggle(False)
runfoam = CarbonflyRunFoam(case_path=createcfcase.case_path, distro="Ubuntu-20.04", run=run_6)  # -> log; inputs case_path: String, distro: String, foam_bashrc: String, run: Boolean
#   port case_path: Carbonfly case path
#   port distro: Name of the WSL distribution/profile to run the command in (e.g., “Ubuntu-22.04”); leave blank to use your default WSL.
#   port foam_bashrc: Path to the OpenFOAM bashrc file to source before running the command (e.g., “/opt/openfoam10/etc/bashrc”); leave blank to skip sourcing/use the current environment.
#   port run: When True, run OpenFOAM
# ---------- runfoam: Python ----------
# GH inputs:
#   case_path (Text)
#   run (Boolean)
# GH outputs:
#   log (Text)

from pathlib import Path

from carbonfly.wsl import run_foam_console

def _win_to_wsl_path(p: str) -> str:
    """Convert a Windows path to a WSL path (/mnt/<drive>/...). Minimal but sufficient here."""
    p = str(p).replace("\\", "/")
    if len(p) >= 2 and p[1] == ":":
        return f"/mnt/{p[0].lower()}/{p[2:]}"
    return p

logs = []
try:
    # Validate inputs
    if not case_path or not str(case_path).strip():
        raise ValueError("case_path is required (full path to the case folder).")

    case_dir = Path(str(case_path)).expanduser()

    if not run:
        # Dry-run: do not execute
        logs.append("This component will execute:  buoyantReactingFoam")
        logs.append("\n=== Click RUN to start simulation ===")
        log = "\n".join(str(x) for x in logs)

    else:
        # On run: enforce required files
        logs.append("")
        logs.append("[Run] Launching buoyantReactingFoam ...")

        rc = run_foam_console(
            case_root=case_dir,
            foam_bashrc=(foam_bashrc or "/opt/openfoam10/etc/bashrc"),
            distro=distro or None,
        )

        if rc == 0:
            logs.append("[OK] Please check the console opened.")
        else:
            logs.append(f"[Warning] buoyantReactingFoam exited with return code: {rc}")
            logs.append("Please review the console output and OpenFOAM logs for details.")

        log = "\n".join(str(x) for x in logs)

except Exception as e:
    log = f"[Error] {e}"
# ---------- end runfoam ----------
panel_74 = Panel(runfoam)

# ----
# Step 6 - foamMonitor (optional):
# live monitoring tool to track residuals during simulation
# Click here to run!
# Before closing Grasshopper, remember to switch the Run button
# back to False, otherwise it will run automatically the next time you open it!
run_7 = BooleanToggle(False)
foammonitor = CarbonflyFoamMonitor(case_path=createcfcase.case_path, distro="Ubuntu-20.04", run=run_7)  # -> log; inputs case_path: String, distro: String, foam_bashrc: String, start_time: Double, run: Boolean
#   port case_path: Carbonfly case path
#   port distro: Name of the WSL distribution/profile to run the command in (e.g., “Ubuntu-22.04”); leave blank to use your default WSL.
#   port foam_bashrc: Path to the OpenFOAM bashrc file to source before running the command (e.g., “/opt/openfoam10/etc/bashrc”); leave blank to skip sourcing/use the current environment.
#   port start_time: Monitor residuals from time/iteration {start_time}, default: 0
#   port run: When True, run foamMonitor
# ---------- foammonitor: Python ----------
# GH inputs:
#   case_path (Text)
#   start_time (Float)
#   run (Boolean)
# GH outputs:
#   log (Text)

from pathlib import Path

from carbonfly.wsl import run_foam_monitor_console

def _win_to_wsl_path(p: str) -> str:
    """Convert a Windows path to a WSL path (/mnt/<drive>/...). Minimal but sufficient here."""
    p = str(p).replace("\\", "/")
    if len(p) >= 2 and p[1] == ":":
        return f"/mnt/{p[0].lower()}/{p[2:]}"
    return p

logs = []
try:
    # Validate inputs
    if not case_path or not str(case_path).strip():
        raise ValueError("case_path is required (full path to the case folder).")

    case_dir = Path(str(case_path)).expanduser()

    if start_time is None:
        start_time = 0

    if not run:
        # Dry-run: do not execute
        logs.append(f"This component will execute:  `foamMonitor -l postProcessing/residuals/{start_time}/residuals.dat`")
        logs.append("\n=== Click RUN to start foamMonitor ===")
        log = "\n".join(str(x) for x in logs)

    else:
        # On run: enforce required files
        logs.append("")
        logs.append("[Run] Launching foamMonitor ...")

        rc = run_foam_monitor_console(
            case_root=case_dir,
            foam_bashrc=(foam_bashrc or "/opt/openfoam10/etc/bashrc"),
            distro=distro or None,
            start_time=start_time
        )

        if rc == 0:
            logs.append("[OK] Please check the console opened.")
        else:
            logs.append(f"[Warning] foamMonitor exited with return code: {rc}")
            logs.append("Please review the console output and OpenFOAM logs for details.")

        log = "\n".join(str(x) for x in logs)

except Exception as e:
    log = f"[Error] {e}"
# ---------- end foammonitor ----------
panel_75 = Panel(foammonitor)

# ==== cluster ManikinLOD0: Create a manikin with Level of Details of 0
angle = ClusterInput()
unit = ClusterInput()
width = ClusterInput()
height = ClusterInput()
stv_height = ClusterInput()
activity = ClusterInput()
breathing_flow_rate = ClusterInput()
mouth_scaling = ClusterInput()
base_point = ClusterInput()
py3 = Python3Script(
    unit=unit,
    width=width,
    height=height,
    StV_height=stv_height,
    activity=activity,
    breathing_flow_rate=breathing_flow_rate,
    mouth_scaling=mouth_scaling,
    angle=angle)  # -> width, height, stv_height, mouth_w, mouth_h, angle, breathing_U; inputs unit: String, width: Double, height: Double, StV_height: Double, activity: String, breathing_flow_rate: Double, mouth_scaling: Double
#   port unit: "mm" (default), "cm", "m"
#   port StV_height: Stomion (mouth) to vertex height. For reference: 1) Adult: ~16-17 cm (females) / ~17-18 cm (males); 2) Children (6–12 years): ~12-15 cm
#   port activity: The level of activity: "light" / "medium" / "heavy", affects the size of the mouth opening
#   port breathing_flow_rate: Average breathing flow rate in L/min, default: 7.2 (light activity) / 18 (medium) / 60 (heavy)
#   port mouth_scaling: Mouth opening scaling factor: 1 - 5, default: 3. A larger scale factor increases the mouth's opening area, reducing velocity while maintaining flow rate, thereby simplifying the mesh.
#   port angle: Rotation angles in radians
#   port breathing_U: Breathing velocity U in m/s
# ---------- py3: Python ----------
if unit == "m":
    _scale_factor = 1e-3
elif unit == "cm":
    _scale_factor = 1e-1
else:
    _scale_factor = 1

if StV_height is None:
    StV_height = 170 * _scale_factor

if mouth_scaling is None:
    _mouth_scaling = 4
elif mouth_scaling < 1:
    _mouth_scaling = 1
elif mouth_scaling > 5:
    _mouth_scaling = 5
else:
    _mouth_scaling = mouth_scaling

if angle is None:
    _angle = 0
else:
    _angle = angle

# width = [200, 800] mm
_width = min(max(width, 200 * _scale_factor), 800 * _scale_factor)

# height = [500, 2200] mm
_height = min(max(height, 500 * _scale_factor), 2200 * _scale_factor)

# stomia to vertex height = [120, 200] mm
_stv_height = min(max(StV_height, 120 * _scale_factor), 200 * _scale_factor)

if activity == "medium":
    # ~3 cm^2
    _mouth_w = 40 * _mouth_scaling * _scale_factor   # 4 cm
    _mouth_h = 7.5 * _mouth_scaling * _scale_factor    # 0.75 cm
elif activity == "heavy":
    # ~6 cm^2
    _mouth_w = 40 * _mouth_scaling * _scale_factor   # 4 cm
    _mouth_h = 12.5 * _mouth_scaling * _scale_factor    # 1.25 cm
else:
    # ~1 cm^2
    _mouth_w = 20 * _mouth_scaling * _scale_factor   # 2 cm
    _mouth_h = 5 * _mouth_scaling * _scale_factor   # 0.5 cm


# breathing_U
if breathing_flow_rate is None:
    if activity == "heavy":
        breathing_flow_rate = 60.0   # L/min
    elif activity == "medium":
        breathing_flow_rate = 18.0   # L/min
    else:
        breathing_flow_rate = 7.2    # L/min

# clamp to a reasonable range
breathing_flow_rate = float(min(max(breathing_flow_rate, 1.0), 200.0))

# calculate breathing_U in m/s
if unit == "m":
    _mouth_area = _mouth_w * _mouth_h           # m^2
elif unit == "cm":
    _mouth_area = (_mouth_w * _mouth_h) * 1e-4  # cm^2 -> m^2
else:
    _mouth_area = (_mouth_w * _mouth_h) * 1e-6  # mm^2 -> m^2
# L/min -> m^3/s
_breathing_Q_m3s = breathing_flow_rate * (1e-3 / 60.0)
# velocity (m/s)
breathing_U = _breathing_Q_m3s / _mouth_area
# ---------- end py3 ----------
base_point_2 = Point(base_point)
division = Division(A=py3.width, B=2)
X = UnitX(Factor=division)
Y = UnitY(Factor=division)
neg = Negative(Value=X)
neg_2 = Negative(Value=Y)
neg_3 = Negative(Value=Y)
move = Move(Geometry=base_point_2, Motion=X)  # -> Geometry, Transform
move_2 = Move(Geometry=base_point_2, Motion=neg)  # -> Geometry, Transform
move_3 = Move(Geometry=move_2.Geometry, Motion=Y)  # -> Geometry, Transform
move_4 = Move(Geometry=move.Geometry, Motion=neg_2)  # -> Geometry, Transform
move_5 = Move(Geometry=move.Geometry, Motion=Y)  # -> Geometry, Transform
move_6 = Move(Geometry=move_2.Geometry, Motion=neg_3)  # -> Geometry, Transform
srf4pt = _4PointSurface(CornerA=move_4.Geometry, CornerB=move_5.Geometry, CornerC=move_3.Geometry, CornerD=move_6.Geometry)
Z = UnitZ(Factor=200)
move_7 = Move(Geometry=srf4pt, Motion=Z)  # -> Geometry, Transform
Z_2 = UnitZ(Factor=py3.height)
extr = Extrude(Base=move_7.Geometry, Direction=Z_2)
debrep = DeconstructBrep(Brep=extr)  # -> Faces, Edges, Vertices
item = ListItem(List=debrep.Faces, Index=Slider(5, range=0..6), Wrap=True)
item_2 = ListItem(List=debrep.Faces, Index=Slider(2, range=0..6), Wrap=True)
item_3 = ListItem(List=debrep.Faces, Index=Slider(3, range=0..6), Wrap=True)
item_4 = ListItem(List=debrep.Faces, Index=Slider(0, range=0..6), Wrap=True)
item_5 = ListItem(List=debrep.Faces, Index=Slider(4, range=0..6), Wrap=True)
item_6 = ListItem(List=debrep.Edges, Index=Slider(5, range=0..6), Wrap=True)
item_7 = ListItem(List=debrep.Faces, Index=Slider(1, range=0..6), Wrap=True)
neg_4 = Negative(Value=py3.stv_height)
division_2 = Division(A=py3.mouth_w, B=2)
division_3 = Division(A=py3.mouth_h, B=2)
midpt = CurveMiddle(Curve=item_6)
Z_3 = UnitZ(Factor=neg_4)
Z_4 = UnitZ(Factor=division_3)
Y_2 = UnitY(Factor=division_2)
pcen = PolygonCenter(Polyline=item)  # -> CenterV, CenterE, CenterA
neg_5 = Negative(Value=Z_4)
move_8 = Move(Geometry=midpt, Motion=Z_3)  # -> Geometry, Transform
neg_6 = Negative(Value=Y_2)
move_9 = Move(Geometry=move_8.Geometry, Motion=Y_2)  # -> Geometry, Transform
move_10 = Move(Geometry=move_8.Geometry, Motion=neg_6)  # -> Geometry, Transform
ln = Line(StartPoint=pcen.CenterV, EndPoint=base_point_2)
move_11 = Move(Geometry=move_9.Geometry, Motion=Z_4)  # -> Geometry, Transform
move_12 = Move(Geometry=move_9.Geometry, Motion=neg_5)  # -> Geometry, Transform
move_13 = Move(Geometry=move_10.Geometry, Motion=Z_4)  # -> Geometry, Transform
move_14 = Move(Geometry=move_10.Geometry, Motion=neg_5)  # -> Geometry, Transform
srf4pt_2 = _4PointSurface(CornerA=move_12.Geometry, CornerB=move_11.Geometry, CornerC=move_13.Geometry, CornerD=move_14.Geometry)
sdiff = SolidDifference(BrepsA=item_7, BrepsB=srf4pt_2)
merge = Merge(Data1=item, Data2=item_4, Data3=item_2, Data4=item_3, Data5=item_5, Data6=sdiff)
rotax = RotateAxis(Geometry=merge, Angle=py3.angle, Axis=ln)  # -> Geometry, Transform
rotax_2 = RotateAxis(Geometry=srf4pt_2, Angle=py3.angle, Axis=ln)  # -> Geometry, Transform
body = Surface(rotax.Geometry)
area = Area(Geometry=body)  # -> Area, Centroid
ma = MassAddition(Input=area.Area)  # -> Result, PartialResults
mouth = Surface(rotax_2.Geometry)
py3_2 = Python3Script(unit=unit, R=ma.Result)  # -> BSA
# ---------- py3_2: Python ----------
if unit == "m":
    BSA = R         # m^2
elif unit == "cm":
    BSA = R * 1e-4   # cm^2 -> m^2
else:
    BSA = R * 1e-6   # mm^2 -> m^2
# ---------- end py3_2 ----------
breathing_u = ClusterOutput(py3.breathing_U)
mouth_2 = ClusterOutput(mouth)
body_2 = ClusterOutput(body)
body_surface_area = Number(py3_2)
body_surface_area_2 = ClusterOutput(body_surface_area)
