# Grasshopper definition 07_postprocessing_points.gh (Grasshopper 1.0.8)

# ----
# Room model of Example 3a (for display only)
number_slider = Slider(3500, range=0..5000)
pt = ConstructPoint(XCoordinate=0, YCoordinate=0, ZCoordinate=0)
pt_2 = ConstructPoint(XCoordinate=number_slider, YCoordinate=0, ZCoordinate=0)
pt_3 = ConstructPoint(XCoordinate=0, YCoordinate=number_slider, ZCoordinate=0)
pt_4 = ConstructPoint(XCoordinate=number_slider, YCoordinate=number_slider, ZCoordinate=0)
Z = UnitZ(Factor=Slider(3000, range=0..5000))
srf4pt = _4PointSurface(CornerA=pt, CornerB=pt_2, CornerC=pt_4, CornerD=pt_3)
Z_2 = UnitZ(Factor=Slider(1100, range=0..2000))
X = UnitX(Factor=Slider(1200, range=0..2000))
extr = Extrude(Base=srf4pt, Direction=Z)
debrep = DeconstructBrep(Brep=extr)  # -> Faces, Edges, Vertices
item = ListItem(List=debrep.Faces, Index=Slider(1, range=1..7), Wrap=True)
item_2 = ListItem(List=debrep.Faces, Index=Slider(2, range=1..7), Wrap=True)
item_3 = ListItem(List=debrep.Faces, Index=Slider(3, range=1..7), Wrap=True)
item_4 = ListItem(List=debrep.Faces, Index=Slider(4, range=1..7), Wrap=True)
item_5 = ListItem(List=debrep.Faces, Index=Slider(5, range=1..7), Wrap=True)
item_6 = ListItem(List=debrep.Faces, Index=Slider(6, range=1..7), Wrap=True)
xz = XZPlane(Origin=Point(0, 0, 0))
scale_nu = ScaleNU(Geometry=item, Plane=xz, ScaleX=0.4, ScaleY=0.4, ScaleZ=1)  # -> Geometry, Transform
move = Move(Geometry=scale_nu.Geometry, Motion=Z_2)  # -> Geometry, Transform
move_2 = Move(Geometry=move.Geometry, Motion=X)  # -> Geometry, Transform
sdiff = SolidDifference(BrepsA=item, BrepsB=move_2.Geometry)
preview = CustomPreview(Geometry=[item_2, item_3, item_4, item_6, item_5], Material=ColourSwatch(SwatchColor=RGBA(255, 255, 255, 105)))
preview_2 = CustomPreview(Geometry=sdiff, Material=ColourSwatch(SwatchColor=RGBA(0, 178, 255, 105)))
preview_3 = CustomPreview(Geometry=move_2.Geometry, Material=ColourSwatch(SwatchColor=RGB(51, 255, 0)))

# ----
# Manikin model of Example 3a (for display only)
number_slider_2 = Slider(0.5, range=0..2)
pi = Pi(Factor=number_slider_2)
pt_5 = ConstructPoint(XCoordinate=Slider(2000, range=0..5000), YCoordinate=Slider(2200, range=0..5000), ZCoordinate=0)
manikin_lod_0 = ManikinLOD0(
    base_point=pt_5,
    unit="mm",
    width=Slider(340, range=0..5000),
    height=Slider(1080, range=0..5000),
    stv_height=Slider(170, range=0..500),
    activity="light",
    breathing_flow_rate="7.2",
    mouth_scaling=Slider(4, range=1..5),
    angle=pi)  # -> body_surface_area_2, body_2, mouth_2, breathing_u
bsa_in_m2 = Panel(manikin_lod_0.body_surface_area_2)
breathing_velocity_in_m_s = Panel(manikin_lod_0.breathing_u)
preview_4 = CustomPreview(Geometry=manikin_lod_0.body_2, Material=ColourSwatch(SwatchColor=RGBA(0, 0, 0, 150)))
preview_5 = CustomPreview(Geometry=manikin_lod_0.mouth_2, Material=ColourSwatch(SwatchColor=RGBA(255, 0, 0, 150)))

# ----
# The requirement here is that you have already
# run the 03a simulation and obtained the results.
number_slider_3 = Slider(1000, range=0..3000)
panel = Panel("C:\Data\Carbonfly\03a_simple_nat_vent_human_lod0_transient")
pt_6 = ConstructPoint(XCoordinate=number_slider_3, YCoordinate=Slider(821, range=0..3000), ZCoordinate=Slider(1000, range=0..3000))
pt_7 = ConstructPoint(
    XCoordinate=Slider(2546, range=0..3000),
    YCoordinate=Slider(2425, range=0..3000),
    ZCoordinate=Slider(1000, range=0..3000))
pt_8 = ConstructPoint(
    XCoordinate=Slider(1522, range=0..3000),
    YCoordinate=Slider(1611, range=0..3000),
    ZCoordinate=Slider(2496, range=0..3000))
merge = Merge(Data1=pt_6, Data2=pt_7, Data3=pt_8)

# ----
# Step 2:
# Run OpenFOAM post-processing
# for internalProbes.
panel_2 = Panel("100:210")
panel_3 = Panel("latest")
panel_4 = Panel("150")
run = BooleanToggle(False)
postprocess = CarbonflyPostProcess(case_path=panel, run=run)  # -> log; inputs case_path: String, distro: String, foam_bashrc: String, time_selector: String, run: Boolean
#   port case_path: Carbonfly case path
#   port distro: Name of the WSL distribution/profile to run the command in (e.g., “Ubuntu-22.04”); leave blank to use your default WSL.
#   port foam_bashrc: Path to the OpenFOAM bashrc file to source before running the command (e.g., “/opt/openfoam10/etc/bashrc”); leave blank to skip sourcing/use the current environment.
#   port time_selector: (Optional) Controls which time(s) to process: - leave it empty: process all available times - <string> "latestTime" or "latest" or "last": run with -latestTime - <integer> e.g. "100": run with -time 100 - <interval> e.g. "0:100": run with -time 0:100
#   port run: When True, run postProcess
# ---------- postprocess: Python ----------
# GH inputs:
#   case_path (Text)
#   distro (Text)           # optional, e.g. "Ubuntu-20.04"
#   foam_bashrc (Text)      # optional, e.g. "/opt/openfoam10/etc/bashrc"
#   time_selector (Text)    # optional:
                            # None  -> no time option (process all)
                            # "latestTime" or "latest" or "last"  -> -latestTime
                            # "100" -> -time 100
                            # "0:100"   -> -time 0:100
#   run (Boolean)
# GH outputs:
#   log (Text)

from pathlib import Path
import carbonfly.postproc as cfpost

if run and case_path:
    rc = cfpost.run_internal_probes_postprocess(
        Path(case_path),
        distro=distro or None,
        foam_bashrc=(foam_bashrc or "/opt/openfoam10/etc/bashrc"),
        time_selector=time_selector or None,
    )
    log = "postProcess internalProbes finished with return code {}\n".format(rc)
    log += "[OK] Please check the console opened."
else:
    log = f"Time selected: {time_selector}\n\n"
    log += "=== Click RUN to open console and run postProcess -func internalProbes ==="
# ---------- end postprocess ----------
panel_5 = Panel(postprocess)

# ----
# Step 1:
# Write OpenFOAM internalProbes dictionary
# for post-processing.
panel_6 = Panel("CO2")
panel_7 = Panel("p")
run_2 = BooleanToggle(False)
internalprobes = InternalProbes(case_path=panel, points=flatten(merge), fields=flatten(["T", panel_6, "U"]), run=run_2)  # -> log; inputs case_path: String, points: list of Point3d, unit: String, fields: list of String, run: Boolean
#   port case_path: Carbonfly case path
#   port points: Probe point locations to be written into system/internalProbes. Accepts a single point or a list of points. Units are interpreted according to the unit input.
#   port unit: (Optional) Unit of the input points. Supported values: "m", "cm", or "mm" (default). The component automatically converts the points to meters before writing them to the OpenFOAM dictionary.
#   port fields: Name or list of field names to be sampled at the given points (for example: CO2, T, U, p). Field names must match those available in the OpenFOAM case.
#   port run: When True, write internalProbes
# ---------- internalprobes: Python ----------
# GH inputs:
#   case_path (Text)
#   points (Point3d or List of Point3d)
#   unit (Text)     # optional, m / cm / mm
#   fields (Text or List of Text)
#   run (Boolean)
# GH outputs:
#   log (Text)

from pathlib import Path
import carbonfly.postproc as cfpost
from carbonfly.utils import unit_scale_to_m

def _norm_unit(u):
    u = (u or "mm").strip().lower()
    if u not in ("mm", "cm", "m"):
        raise ValueError("unit must be 'mm', 'cm', or 'm'")
    return u

unit_in  = _norm_unit(unit)
scale_to_m = unit_scale_to_m(unit_in)
points_m = tuple(pt * scale_to_m for pt in points)
probe_points = [(pt.X, pt.Y, pt.Z) for pt in points_m]

if run and case_path:
    try:
        path = cfpost.write_internal_probes_dict(
            Path(case_path),
            points=probe_points,
            fields=fields,
        )
        log = f"[OK] internalProbes has been created in: {path}"
    except Exception as e:
        log = str(e)
else:
    log = f"Fields: {fields}\n"
    log += f"Points [m]: {probe_points}\n\n"
    log += "=== Click RUN to write internalProbes dict for post-processing ==="
# ---------- end internalprobes ----------
panel_8 = Panel(internalprobes)

# ----
# Step 3:
# Read and visualize results.
number_slider_4 = Slider(-1, range=-1..60)
read_results = ReadResults(case_path=panel, which=number_slider_4, field="U")  # -> time_dir, points, values; inputs case_path: String, which: String, field: String
#   port case_path: Carbonfly case path
#   port which: (Optional) which result to read: 1. "latest" / "last": read the newest time dir (default) 2. <int> for example: - "0": read the first time dir (smallest time) - "2": read the 3rd time dir - "-1": read the last time dir
#   port field: Field name to extract (e.g. CO2, T, U, p).
#   port unit: Unit for output probe coordinates (m, cm, or mm; default mm).
#   port time_dir: Name of the time directory that was actually read (e.g. 2000).
#   port points: Probe coordinates converted to the Rhino unit (as Vector3d).
#   port values: Field values at these probes (list of numbers, or list of Vector3d for U).
# ---------- read_results: Python ----------
# GH inputs:
#   case_path (Text)
#   which (Text)    # optional:
                    # "latest" or "last": read the last (usually largest) time directory
                    # int >= 0: read the N-th directory in sorted order (0 = first)
                    # int < 0: read from the end (-1 = last, -2 = second last, ...)
#   field (Text)
#   unit (Text)
# GH outputs:
#   time_dir
#   points
#   values

import Rhino
from pathlib import Path
import carbonfly.postproc as cfpost
from carbonfly.utils import unit_scale_to_m

def _norm_unit(u):
    u = (u or "mm").strip().lower()
    if u not in ("mm", "cm", "m"):
        raise ValueError("unit must be 'mm', 'cm', or 'm'")
    return u

results = None
points_m = None
values = None

if which is None or which == "":
    which = "latest"
else:
    if isinstance(which, str):
        s = which.strip()
        try:
            which = int(s)
        except ValueError:
            which = s
    elif isinstance(which, float) and which.is_integer():
        which = int(which)


results = cfpost.collect_internal_probes_results(
    Path(case_path),
    which=which,
)
time_dir = results["time_dir"]
data = results["data"]
points_m = data["points"]
# convert back to Rhino unit
unit_in  = _norm_unit(unit)
scale_to_m = unit_scale_to_m(unit_in)
points = [
    Rhino.Geometry.Vector3d(
        x_m / scale_to_m, 
        y_m / scale_to_m, 
        z_m / scale_to_m
    )
    for (x_m, y_m, z_m) in points_m
]

# read data
if field == "U":
    u_list = data["vectors"].get("U", [])
    values = [
        Rhino.Geometry.Vector3d(ux, uy, uz)
        for (ux, uy, uz) in u_list
    ]
else:
    values = data["scalars"][field]
# ---------- end read_results ----------
read_results_2 = ReadResults(case_path=panel, which=number_slider_4, field="CO2")  # -> time_dir, points, values; inputs case_path: String, which: String, field: String; same code as read_results
read_results_3 = ReadResults(case_path=panel, which=number_slider_4, field="T")  # -> time_dir, points, values; inputs case_path: String, which: String, field: String; same code as read_results
panel_9 = Panel(read_results_3.time_dir)
panel_10 = Panel(read_results.time_dir)
panel_11 = Panel(read_results_3.points)
panel_12 = Panel(read_results_2.time_dir)
panel_13 = Panel(read_results.points)
panel_14 = Panel(read_results_2.points)
panel_15 = Panel(read_results_3.values)
panel_16 = Panel(read_results.values)
panel_17 = Panel(read_results_2.values)
pt_9 = ConstructPoint(XCoordinate=Slider(3500, range=0..5000), YCoordinate=Slider(3600, range=0..5000), ZCoordinate=0)
Y = UnitY(Factor=1)
Z_3 = UnitZ(Factor=1)
concat = Concatenate(FragmentA="Time: ", FragmentB=read_results_3.time_dir)
Y_2 = UnitY(Factor=1)
Z_4 = UnitZ(Factor=1)
pl = ConstructPlane(Origin=pt_9, XAxis=Y, YAxis=Z_3)
Y_3 = UnitY(Factor=1)
Z_5 = UnitZ(Factor=1)
Y_4 = UnitY(Factor=1)
Z_6 = UnitZ(Factor=1)
tag = TextTag3D(
    Location=pl,
    Text=concat,
    Size=Slider(100, range=10..1000),
    Colour=ColourSwatch(SwatchColor=RGB(0, 0, 0)),
    Justification=7)

# ----
# K -> degree C
panel_18 = Panel("273.15")
subtraction = Subtraction(A=read_results_3.values, B=panel_18)

# ----
# volume fraction -> ppm
panel_19 = Panel("1000000")
multiplication = Multiplication(A=read_results_2.values, B=panel_19)

# ----
# Offset for display
number_slider_5 = Slider(300, range=0..1000)
Z_7 = UnitZ(Factor=number_slider_5)
move_3 = Move(Geometry=read_results_3.points, Motion=Z_7)  # -> Geometry, Transform

# ----
# Wind direction only,
# no scaling based on
# wind speed
number_slider_6 = Slider(200, range=10..1000)
unit = UnitVector(Vector=read_results.values)
multiplication_2 = Multiplication(A=unit, B=number_slider_6)

# ----
# Offset for display
number_slider_7 = Slider(0, range=0..1000)
Z_8 = UnitZ(Factor=number_slider_7)
move_4 = Move(Geometry=read_results.points, Motion=Z_8)  # -> Geometry, Transform

# ----
# Offset for display
number_slider_8 = Slider(150, range=0..1000)
Z_9 = UnitZ(Factor=number_slider_8)
move_5 = Move(Geometry=read_results_2.points, Motion=Z_9)  # -> Geometry, Transform

# ----
# velocity magnitude
vlen = VectorLength(Vector=read_results.values)

# ----
# unit
panel_20 = Panel(" degC")
concat_2 = Concatenate(FragmentA=subtraction, FragmentB=panel_20)

# ----
# unit
panel_21 = Panel(" m/s")
concat_3 = Concatenate(FragmentA=vlen, FragmentB=panel_21)

# ----
# unit
panel_22 = Panel(" ppm")
concat_4 = Concatenate(FragmentA=multiplication, FragmentB=panel_22)

pl_2 = ConstructPlane(Origin=move_3.Geometry, XAxis=Y_2, YAxis=Z_4)
vdisex = VectorDisplayEx(
    Point=read_results.points,
    Vector=multiplication_2,
    Colour=ColourSwatch(SwatchColor=RGB(161, 0, 0)),
    Width=Slider(2, range=1..20))
pl_3 = ConstructPlane(Origin=move_5.Geometry, XAxis=Y_3, YAxis=Z_5)
pl_4 = ConstructPlane(Origin=move_4.Geometry, XAxis=Y_4, YAxis=Z_6)
tag_2 = TextTag3D(
    Location=pl_2,
    Text=concat_2,
    Size=Slider(80, range=10..1000),
    Colour=ColourSwatch(SwatchColor=RGB(201, 0, 0)),
    Justification=7)
tag_3 = TextTag3D(
    Location=pl_3,
    Text=concat_4,
    Size=Slider(80, range=10..1000),
    Colour=ColourSwatch(SwatchColor=RGB(0, 18, 176)),
    Justification=7)
tag_4 = TextTag3D(
    Location=pl_4,
    Text=concat_3,
    Size=Slider(80, range=10..1000),
    Colour=ColourSwatch(SwatchColor=RGB(0, 147, 163)),
    Justification=7)

# ----
# Offset for display
number_slider_9 = Slider(-150, range=-300..1000)
Z_10 = UnitZ(Factor=number_slider_9)
move_6 = Move(Geometry=read_results_2.points, Motion=Z_10)  # -> Geometry, Transform

# ----
# Step 4:
# Indoor Air Quality evaluation using CO2 concentration, based on different international/national standards
carbonfly_iaq_standards = CarbonflyIAQStandards({"European standard CEN/EN 16798-1": "EN", "Japanese law for environmental health in buildings (LEHB)": "LEHB", "Singapore standard SS 554:2016": "SS", "Hong Kong Environmental Protection Department": "HK", "German environmental protection agency (Umweltbundesamt)": "UBA", "Department of Occupational Safety and Health (DOSH) Malaysia": "DOSH", "Brazilian standard ABNT NBR 16401-3:2008 and NBR 17037:2023": "NBR"}, selected="European standard CEN/EN 16798-1")
co2_based_iaq = CO2BasedIAQ(CO2_indoor=multiplication, standard=carbonfly_iaq_standards)  # -> report, index; inputs CO2_indoor: list of Double, CO2_outdoor: list of Double, standard: String
#   port CO2_indoor: Indoor CO2 concentration (ppm)
#   port CO2_outdoor: Outdoor CO2 concentration (ppm); if empty, 400 ppm is used
#   port standard: CO2-based IAQ evaluation standard to apply: - European standard CEN/EN 16798-1 = "EN" - Japanese law for environmental health in buildings (LEHB) = "LEHB" - Singapore standard SS 554:2016 = "SS" - Hong Kong Environmental Protection Department = "HK" - German environmental protection agency (Umweltbundesamt) = "UBA" - Department of Occupational Safety and Health (DOSH) Malaysia = "DOSH" - Brazilian standard ABNT NBR 16401-3:2008 and NBR 17037:2023 = "NBR"
#   port index: The IAQ Index/Category. For description please see IAQ report
# ---------- co2_based_iaq: Python ----------
from carbonfly.iaq import iaq_co2

results = iaq_co2(
    co2_indoor = CO2_indoor,
    co2_outdoor = CO2_outdoor or 400,
    standard = standard or "EN"
)

reports = results[0]
index = results[1]

standard_name = reports["standard"]
co2_indoor = reports["co2_indoor"]
co2_outdoor = reports["co2_outdoor"]

if standard == "EN":
    description = (
        "Evaluation based on CO2 concentration differences between indoors and outdoors.\n"
        "- [Index = 1] Category I: ΔCO2 <= 550 ppm\n"
        "- [Index = 2] Category II: ΔCO2 <= 800 ppm\n"
        "- [Index = 3] Category III: ΔCO2 <= 1350 ppm\n"
        "- [Index = 4] Category IV: ΔCO2 > 1350 ppm"
    )
elif standard == "LEHB":
    description = (
        "Evaluation based on CO2 concentration indoors.\n"
        "- [Index = 1] Acceptable: CO2 <= 1000 ppm\n"
        "- [Index = 2] Unacceptable: CO2 > 1000 ppm"
    )
elif standard == "SS":
    description = (
        "Evaluation based on CO2 concentration differences between indoors and outdoors.\n"
        "- [Index = 1] Acceptable: ΔCO2 <= 700 ppm\n"
        "- [Index = 2] Unacceptable: ΔCO2 > 700 ppm"
    )
elif standard == "HK":
    description = (
        "Evaluation based on CO2 concentration indoors (averaging time 8-hour)."
        "Here the average is changed to an instantaneous evaluation for each measurment.\n"
        "- [Index = 1] Excellent Class: CO2 <= 800 ppm\n"
        "- [Index = 2] Good Class: CO2 <= 1000 ppm\n"
        "- [Index = 3] Unacceptable: CO2 > 1000 ppm"
    )
elif standard == "UBA":
    description = (
        "Evaluation based on CO2 concentration indoors.\n"
        "- [Index = 1] Hygienically safe: CO2 < 1000 ppm\n"
        "- [Index = 2] Hygienically conspicuous: CO2 <= 2000 ppm\n"
        "- [Index = 3] Hygienically unacceptable: CO2 > 2000 ppm"
    )
elif standard == "DOSH":
    description = (
        "Evaluation based on CO2 concentration indoors.\n"
        "- [Index = 1] Acceptable: CO2 <= 1000 ppm\n"
        "- [Index = 2] Unacceptable: CO2 > 1000 ppm"
    )
elif standard == "NBR":
    description = (
        "Evaluation based on CO2 concentration differences between indoors and outdoors.\n"
        "- [Index = 1] Acceptable: ΔCO2 <= 700 ppm\n"
        "- [Index = 2] Unacceptable: ΔCO2 > 700 ppm"
    )
else:
    description = "N/A"

report = (
    f"Standard: {standard_name}\n"
    f"CO2 indoor: {co2_indoor} ppm\n"
    f"CO2 outdoor: {co2_outdoor} ppm\n"
    f"Index: {index}\n"
    "\n"
    f"{description}"
)
# ---------- end co2_based_iaq ----------
panel_23 = Panel(co2_based_iaq.report)
panel_24 = Panel(co2_based_iaq.index)
panel_25 = Panel("""):
Category """)
Y_5 = UnitY(Factor=1)
Z_11 = UnitZ(Factor=1)
pl_5 = ConstructPlane(Origin=move_6.Geometry, XAxis=Y_5, YAxis=Z_11)

concat_5 = Concatenate(A="IAQ (Standard ", B=carbonfly_iaq_standards, C=panel_25, D=co2_based_iaq.index)

tag_5 = TextTag3D(
    Location=pl_5,
    Text=concat_5,
    Size=Slider(80, range=10..1000),
    Colour=ColourSwatch(SwatchColor=RGB(0, 0, 0)),
    Justification=7)

# ==== cluster ManikinLOD0: Create a manikin with Level of Details of 0
angle = ClusterInput()
unit = ClusterInput()
width = ClusterInput()
height = ClusterInput()
stv_height = ClusterInput()
activity = ClusterInput()
breathing_flow_rate = ClusterInput()
mouth_scaling = ClusterInput()
base_point = ClusterInput()
py3 = Python3Script(
    unit=unit,
    width=width,
    height=height,
    StV_height=stv_height,
    activity=activity,
    breathing_flow_rate=breathing_flow_rate,
    mouth_scaling=mouth_scaling,
    angle=angle)  # -> width, height, stv_height, mouth_w, mouth_h, angle, breathing_U; inputs unit: String, width: Double, height: Double, StV_height: Double, activity: String, breathing_flow_rate: Double, mouth_scaling: Double
#   port unit: "mm" (default), "cm", "m"
#   port StV_height: Stomion (mouth) to vertex height. For reference: 1) Adult: ~16-17 cm (females) / ~17-18 cm (males); 2) Children (6–12 years): ~12-15 cm
#   port activity: The level of activity: "light" / "medium" / "heavy", affects the size of the mouth opening
#   port breathing_flow_rate: Average breathing flow rate in L/min, default: 7.2 (light activity) / 18 (medium) / 60 (heavy)
#   port mouth_scaling: Mouth opening scaling factor: 1 - 5, default: 3. A larger scale factor increases the mouth's opening area, reducing velocity while maintaining flow rate, thereby simplifying the mesh.
#   port angle: Rotation angles in radians
#   port breathing_U: Breathing velocity U in m/s
# ---------- py3: Python ----------
if unit == "m":
    _scale_factor = 1e-3
elif unit == "cm":
    _scale_factor = 1e-1
else:
    _scale_factor = 1

if StV_height is None:
    StV_height = 170 * _scale_factor

if mouth_scaling is None:
    _mouth_scaling = 4
elif mouth_scaling < 1:
    _mouth_scaling = 1
elif mouth_scaling > 5:
    _mouth_scaling = 5
else:
    _mouth_scaling = mouth_scaling

if angle is None:
    _angle = 0
else:
    _angle = angle

# width = [200, 800] mm
_width = min(max(width, 200 * _scale_factor), 800 * _scale_factor)

# height = [500, 2200] mm
_height = min(max(height, 500 * _scale_factor), 2200 * _scale_factor)

# stomia to vertex height = [120, 200] mm
_stv_height = min(max(StV_height, 120 * _scale_factor), 200 * _scale_factor)

if activity == "medium":
    # ~3 cm^2
    _mouth_w = 40 * _mouth_scaling * _scale_factor   # 4 cm
    _mouth_h = 7.5 * _mouth_scaling * _scale_factor    # 0.75 cm
elif activity == "heavy":
    # ~6 cm^2
    _mouth_w = 40 * _mouth_scaling * _scale_factor   # 4 cm
    _mouth_h = 12.5 * _mouth_scaling * _scale_factor    # 1.25 cm
else:
    # ~1 cm^2
    _mouth_w = 20 * _mouth_scaling * _scale_factor   # 2 cm
    _mouth_h = 5 * _mouth_scaling * _scale_factor   # 0.5 cm


# breathing_U
if breathing_flow_rate is None:
    if activity == "heavy":
        breathing_flow_rate = 60.0   # L/min
    elif activity == "medium":
        breathing_flow_rate = 18.0   # L/min
    else:
        breathing_flow_rate = 7.2    # L/min

# clamp to a reasonable range
breathing_flow_rate = float(min(max(breathing_flow_rate, 1.0), 200.0))

# calculate breathing_U in m/s
if unit == "m":
    _mouth_area = _mouth_w * _mouth_h           # m^2
elif unit == "cm":
    _mouth_area = (_mouth_w * _mouth_h) * 1e-4  # cm^2 -> m^2
else:
    _mouth_area = (_mouth_w * _mouth_h) * 1e-6  # mm^2 -> m^2
# L/min -> m^3/s
_breathing_Q_m3s = breathing_flow_rate * (1e-3 / 60.0)
# velocity (m/s)
breathing_U = _breathing_Q_m3s / _mouth_area
# ---------- end py3 ----------
base_point_2 = Point(base_point)
division = Division(A=py3.width, B=2)
X = UnitX(Factor=division)
Y = UnitY(Factor=division)
neg = Negative(Value=X)
neg_2 = Negative(Value=Y)
neg_3 = Negative(Value=Y)
move = Move(Geometry=base_point_2, Motion=X)  # -> Geometry, Transform
move_2 = Move(Geometry=base_point_2, Motion=neg)  # -> Geometry, Transform
move_3 = Move(Geometry=move_2.Geometry, Motion=Y)  # -> Geometry, Transform
move_4 = Move(Geometry=move.Geometry, Motion=neg_2)  # -> Geometry, Transform
move_5 = Move(Geometry=move.Geometry, Motion=Y)  # -> Geometry, Transform
move_6 = Move(Geometry=move_2.Geometry, Motion=neg_3)  # -> Geometry, Transform
srf4pt = _4PointSurface(CornerA=move_4.Geometry, CornerB=move_5.Geometry, CornerC=move_3.Geometry, CornerD=move_6.Geometry)
Z = UnitZ(Factor=200)
move_7 = Move(Geometry=srf4pt, Motion=Z)  # -> Geometry, Transform
Z_2 = UnitZ(Factor=py3.height)
extr = Extrude(Base=move_7.Geometry, Direction=Z_2)
debrep = DeconstructBrep(Brep=extr)  # -> Faces, Edges, Vertices
item = ListItem(List=debrep.Faces, Index=Slider(5, range=0..6), Wrap=True)
item_2 = ListItem(List=debrep.Faces, Index=Slider(2, range=0..6), Wrap=True)
item_3 = ListItem(List=debrep.Faces, Index=Slider(3, range=0..6), Wrap=True)
item_4 = ListItem(List=debrep.Faces, Index=Slider(0, range=0..6), Wrap=True)
item_5 = ListItem(List=debrep.Faces, Index=Slider(4, range=0..6), Wrap=True)
item_6 = ListItem(List=debrep.Edges, Index=Slider(5, range=0..6), Wrap=True)
item_7 = ListItem(List=debrep.Faces, Index=Slider(1, range=0..6), Wrap=True)
neg_4 = Negative(Value=py3.stv_height)
division_2 = Division(A=py3.mouth_w, B=2)
division_3 = Division(A=py3.mouth_h, B=2)
midpt = CurveMiddle(Curve=item_6)
Z_3 = UnitZ(Factor=neg_4)
Z_4 = UnitZ(Factor=division_3)
Y_2 = UnitY(Factor=division_2)
pcen = PolygonCenter(Polyline=item)  # -> CenterV, CenterE, CenterA
neg_5 = Negative(Value=Z_4)
move_8 = Move(Geometry=midpt, Motion=Z_3)  # -> Geometry, Transform
neg_6 = Negative(Value=Y_2)
move_9 = Move(Geometry=move_8.Geometry, Motion=Y_2)  # -> Geometry, Transform
move_10 = Move(Geometry=move_8.Geometry, Motion=neg_6)  # -> Geometry, Transform
ln = Line(StartPoint=pcen.CenterV, EndPoint=base_point_2)
move_11 = Move(Geometry=move_9.Geometry, Motion=Z_4)  # -> Geometry, Transform
move_12 = Move(Geometry=move_9.Geometry, Motion=neg_5)  # -> Geometry, Transform
move_13 = Move(Geometry=move_10.Geometry, Motion=Z_4)  # -> Geometry, Transform
move_14 = Move(Geometry=move_10.Geometry, Motion=neg_5)  # -> Geometry, Transform
srf4pt_2 = _4PointSurface(CornerA=move_12.Geometry, CornerB=move_11.Geometry, CornerC=move_13.Geometry, CornerD=move_14.Geometry)
sdiff = SolidDifference(BrepsA=item_7, BrepsB=srf4pt_2)
merge = Merge(Data1=item, Data2=item_4, Data3=item_2, Data4=item_3, Data5=item_5, Data6=sdiff)
rotax = RotateAxis(Geometry=merge, Angle=py3.angle, Axis=ln)  # -> Geometry, Transform
rotax_2 = RotateAxis(Geometry=srf4pt_2, Angle=py3.angle, Axis=ln)  # -> Geometry, Transform
body = Surface(rotax.Geometry)
area = Area(Geometry=body)  # -> Area, Centroid
ma = MassAddition(Input=area.Area)  # -> Result, PartialResults
mouth = Surface(rotax_2.Geometry)
py3_2 = Python3Script(unit=unit, R=ma.Result)  # -> BSA
# ---------- py3_2: Python ----------
if unit == "m":
    BSA = R         # m^2
elif unit == "cm":
    BSA = R * 1e-4   # cm^2 -> m^2
else:
    BSA = R * 1e-6   # mm^2 -> m^2
# ---------- end py3_2 ----------
breathing_u = ClusterOutput(py3.breathing_U)
mouth_2 = ClusterOutput(mouth)
body_2 = ClusterOutput(body)
body_surface_area = Number(py3_2)
body_surface_area_2 = ClusterOutput(body_surface_area)
