# Grasshopper definition 08_postprocessing_heatmap.gh (Grasshopper 1.0.8)

# ----
# Room model from example 01a, for display only
number_slider = Slider(3000, range=0..5000)
division = Division(A=number_slider, B=10)
division_2 = Division(A=number_slider, B=2)
pt = ConstructPoint(XCoordinate=0, YCoordinate=0, ZCoordinate=0)
pt_2 = ConstructPoint(XCoordinate=number_slider, YCoordinate=0, ZCoordinate=0)
pt_3 = ConstructPoint(XCoordinate=0, YCoordinate=number_slider, ZCoordinate=0)
pt_4 = ConstructPoint(XCoordinate=number_slider, YCoordinate=number_slider, ZCoordinate=0)
Z = UnitZ(Factor=number_slider)
srf4pt = _4PointSurface(CornerA=pt, CornerB=pt_2, CornerC=pt_4, CornerD=pt_3)
X = UnitX(Factor=division_2)
Y = UnitY(Factor=division)
Y_2 = UnitY(Factor=division_2)
pt_5 = ConstructPoint(XCoordinate=division_2, YCoordinate=division_2, ZCoordinate=division_2)
extr = Extrude(Base=srf4pt, Direction=Z)
debrep = DeconstructBrep(Brep=extr)  # -> Faces, Edges, Vertices
scale = Scale(Geometry=extr, Center=pt_5, Factor=0.3)  # -> Geometry, Transform
item = ListItem(List=debrep.Faces, Index=Slider(2, range=1..7), Wrap=True)
item_2 = ListItem(List=debrep.Faces, Index=Slider(3, range=1..7), Wrap=True)
item_3 = ListItem(List=debrep.Faces, Index=Slider(4, range=1..7), Wrap=True)
item_4 = ListItem(List=debrep.Faces, Index=Slider(5, range=1..7), Wrap=True)
item_5 = ListItem(List=debrep.Faces, Index=Slider(6, range=1..7), Wrap=True)
item_6 = ListItem(List=debrep.Faces, Index=Slider(1, range=1..7), Wrap=True)
debrep_2 = DeconstructBrep(Brep=scale.Geometry)  # -> Faces, Edges, Vertices
scale_nu = ScaleNU(Geometry=item_4, Plane=PlaneXY(0, 0, 0), ScaleX=0.2, ScaleY=0.2, ScaleZ=1)  # -> Geometry, Transform
move = Move(Geometry=scale_nu.Geometry, Motion=Y)  # -> Geometry, Transform
move_2 = Move(Geometry=move.Geometry, Motion=X)  # -> Geometry, Transform
move_3 = Move(Geometry=move_2.Geometry, Motion=Y_2)  # -> Geometry, Transform
sdiff = SolidDifference(BrepsA=item_4, BrepsB=[move_2.Geometry, move_3.Geometry])
preview = CustomPreview(Geometry=[item_6, item, item_2, item_3, item_5], Material=ColourSwatch(SwatchColor=RGBA(255, 255, 255, 105)))
preview_2 = CustomPreview(Geometry=[item_6, item_2, item_5, item_3], Material=ColourSwatch(SwatchColor=RGBA(255, 255, 255, 105)))
preview_3 = CustomPreview(Geometry=move_2.Geometry, Material=ColourSwatch(SwatchColor=RGB(51, 255, 0)))
preview_4 = CustomPreview(Geometry=debrep_2.Faces, Material=ColourSwatch(SwatchColor=RGB(0, 0, 0)))
preview_5 = CustomPreview(Geometry=move_3.Geometry, Material=ColourSwatch(SwatchColor=RGB(255, 140, 0)))
preview_6 = CustomPreview(Geometry=sdiff, Material=ColourSwatch(SwatchColor=RGBA(0, 178, 255, 105)))

# ----
# Step 1: Generate a slice mesh to display the heatmap
# Position
# Mesh settings
number_slider_2 = Slider(1500, range=0..5000)
X_2 = UnitX(Factor=number_slider_2)
srf = Surface(item_3)
move_4 = Move(Geometry=srf, Motion=X_2)  # -> Geometry, Transform
split = SplitBrep(Brep=move_4.Geometry, Cutter=scale.Geometry)
item_7 = ListItem(List=split, Index=Slider(0, range=0..2), Wrap=True)
slice = Surface(item_7)
custom_mesh_settings = SettingsCustom(
    StitchSeams=True,
    SimplePlanes=False,
    Refine=True,
    MinCount=Slider(196, range=1..500),
    MaxCount=400,
    AspectRatio=20,
    MaxDistance=0,
    MaxAngle=20,
    MinEdge=Slider(126, range=1..500),
    MaxEdge=0)
preview_7 = CustomPreview(Geometry=slice, Material=ColourSwatch(SwatchColor=RGBA(255, 0, 255, 51)))
mesh = MeshBrep(Brep=slice, Settings=custom_mesh_settings)
demesh = DeconstructMesh(Mesh=mesh)  # -> Vertices, Faces, Colours, Normals
preview_8 = CustomPreview(Geometry=demesh.Vertices, Material=ColourSwatch(SwatchColor=RGB(115, 115, 115)))

panel = Panel("C:\Data\Carbonfly\01a_simple_mech_vent_transient")

# ----
# The requirement here is that you have already
# run the 01a simulation and obtained the results.
# Step 2:
# Write OpenFOAM internalProbes dictionary
# for post-processing.
panel_2 = Panel("CO2")
internalprobes = InternalProbes(case_path=panel, points=flatten(demesh.Vertices), fields=flatten([panel_2, "T", "U"]), run=Toggle(False))  # -> log; inputs case_path: String, points: list of Point3d, unit: String, fields: list of String, run: Boolean
#   port case_path: Carbonfly case path
#   port points: Probe point locations to be written into system/internalProbes. Accepts a single point or a list of points. Units are interpreted according to the unit input.
#   port unit: (Optional) Unit of the input points. Supported values: "m", "cm", or "mm" (default). The component automatically converts the points to meters before writing them to the OpenFOAM dictionary.
#   port fields: Name or list of field names to be sampled at the given points (for example: CO2, T, U, p). Field names must match those available in the OpenFOAM case.
#   port run: When True, write internalProbes
# ---------- internalprobes: Python ----------
# GH inputs:
#   case_path (Text)
#   points (Point3d or List of Point3d)
#   unit (Text)     # optional, m / cm / mm
#   fields (Text or List of Text)
#   run (Boolean)
# GH outputs:
#   log (Text)

from pathlib import Path
import carbonfly.postproc as cfpost
from carbonfly.utils import unit_scale_to_m

def _norm_unit(u):
    u = (u or "mm").strip().lower()
    if u not in ("mm", "cm", "m"):
        raise ValueError("unit must be 'mm', 'cm', or 'm'")
    return u

unit_in  = _norm_unit(unit)
scale_to_m = unit_scale_to_m(unit_in)
points_m = tuple(pt * scale_to_m for pt in points)
probe_points = [(pt.X, pt.Y, pt.Z) for pt in points_m]

if run and case_path:
    try:
        path = cfpost.write_internal_probes_dict(
            Path(case_path),
            points=probe_points,
            fields=fields,
        )
        log = f"[OK] internalProbes has been created in: {path}"
    except Exception as e:
        log = str(e)
else:
    log = f"Fields: {fields}\n"
    log += f"Points [m]: {probe_points}\n\n"
    log += "=== Click RUN to write internalProbes dict for post-processing ==="
# ---------- end internalprobes ----------
panel_3 = Panel(internalprobes)

# ----
# Step 3:
# Run OpenFOAM post-processing
# for internalProbes.
toggle = BooleanToggle(False)
postprocess = CarbonflyPostProcess(case_path=panel, run=toggle)  # -> log; inputs case_path: String, distro: String, foam_bashrc: String, time_selector: String, run: Boolean
#   port case_path: Carbonfly case path
#   port distro: Name of the WSL distribution/profile to run the command in (e.g., “Ubuntu-22.04”); leave blank to use your default WSL.
#   port foam_bashrc: Path to the OpenFOAM bashrc file to source before running the command (e.g., “/opt/openfoam10/etc/bashrc”); leave blank to skip sourcing/use the current environment.
#   port time_selector: (Optional) Controls which time(s) to process: - leave it empty: process all available times - <string> "latestTime" or "latest" or "last": run with -latestTime - <integer> e.g. "100": run with -time 100 - <interval> e.g. "0:100": run with -time 0:100
#   port run: When True, run postProcess
# ---------- postprocess: Python ----------
# GH inputs:
#   case_path (Text)
#   distro (Text)           # optional, e.g. "Ubuntu-20.04"
#   foam_bashrc (Text)      # optional, e.g. "/opt/openfoam10/etc/bashrc"
#   time_selector (Text)    # optional:
                            # None  -> no time option (process all)
                            # "latestTime" or "latest" or "last"  -> -latestTime
                            # "100" -> -time 100
                            # "0:100"   -> -time 0:100
#   run (Boolean)
# GH outputs:
#   log (Text)

from pathlib import Path
import carbonfly.postproc as cfpost

if run and case_path:
    rc = cfpost.run_internal_probes_postprocess(
        Path(case_path),
        distro=distro or None,
        foam_bashrc=(foam_bashrc or "/opt/openfoam10/etc/bashrc"),
        time_selector=time_selector or None,
    )
    log = "postProcess internalProbes finished with return code {}\n".format(rc)
    log += "[OK] Please check the console opened."
else:
    log = f"Time selected: {time_selector}\n\n"
    log += "=== Click RUN to open console and run postProcess -func internalProbes ==="
# ---------- end postprocess ----------
panel_4 = Panel(postprocess)

# ----
# Step 4:
# Read and visualize results.
number_slider_3 = Slider(0, range=-1..60)
read_results = ReadResults(case_path=panel, which=number_slider_3, field="U")  # -> time_dir, points, values; inputs case_path: String, which: String, field: String
#   port case_path: Carbonfly case path
#   port which: (Optional) which result to read: 1. "latest" / "last": read the newest time dir (default) 2. <int> for example: - "0": read the first time dir (smallest time) - "2": read the 3rd time dir - "-1": read the last time dir
#   port field: Field name to extract (e.g. CO2, T, U, p).
#   port unit: Unit for output probe coordinates (m, cm, or mm; default mm).
#   port time_dir: Name of the time directory that was actually read (e.g. 2000).
#   port points: Probe coordinates converted to the Rhino unit (as Vector3d).
#   port values: Field values at these probes (list of numbers, or list of Vector3d for U).
# ---------- read_results: Python ----------
# GH inputs:
#   case_path (Text)
#   which (Text)    # optional:
                    # "latest" or "last": read the last (usually largest) time directory
                    # int >= 0: read the N-th directory in sorted order (0 = first)
                    # int < 0: read from the end (-1 = last, -2 = second last, ...)
#   field (Text)
#   unit (Text)
# GH outputs:
#   time_dir
#   points
#   values

import Rhino
from pathlib import Path
import carbonfly.postproc as cfpost
from carbonfly.utils import unit_scale_to_m

def _norm_unit(u):
    u = (u or "mm").strip().lower()
    if u not in ("mm", "cm", "m"):
        raise ValueError("unit must be 'mm', 'cm', or 'm'")
    return u

results = None
points_m = None
values = None

if which is None or which == "":
    which = "latest"
else:
    if isinstance(which, str):
        s = which.strip()
        try:
            which = int(s)
        except ValueError:
            which = s
    elif isinstance(which, float) and which.is_integer():
        which = int(which)


results = cfpost.collect_internal_probes_results(
    Path(case_path),
    which=which,
)
time_dir = results["time_dir"]
data = results["data"]
points_m = data["points"]
# convert back to Rhino unit
unit_in  = _norm_unit(unit)
scale_to_m = unit_scale_to_m(unit_in)
points = [
    Rhino.Geometry.Vector3d(
        x_m / scale_to_m, 
        y_m / scale_to_m, 
        z_m / scale_to_m
    )
    for (x_m, y_m, z_m) in points_m
]

# read data
if field == "U":
    u_list = data["vectors"].get("U", [])
    values = [
        Rhino.Geometry.Vector3d(ux, uy, uz)
        for (ux, uy, uz) in u_list
    ]
else:
    values = data["scalars"][field]
# ---------- end read_results ----------
read_results_2 = ReadResults(case_path=panel, which=number_slider_3, field="CO2")  # -> time_dir, points, values; inputs case_path: String, which: String, field: String; same code as read_results
read_results_3 = ReadResults(case_path=panel, which=number_slider_3, field="T")  # -> time_dir, points, values; inputs case_path: String, which: String, field: String; same code as read_results
panel_5 = Panel(read_results_3.time_dir)
panel_6 = Panel(read_results.time_dir)
panel_7 = Panel(read_results_3.points)
panel_8 = Panel(read_results_2.time_dir)
panel_9 = Panel(read_results.points)
panel_10 = Panel(read_results_2.points)
panel_11 = Panel(read_results_3.values)
panel_12 = Panel(read_results.values)
panel_13 = Panel(read_results_2.values)
pt_6 = ConstructPoint(XCoordinate=Slider(3000, range=0..5000), YCoordinate=Slider(1800, range=0..5000), ZCoordinate=0)
Y_3 = UnitY(Factor=1)
Z_2 = UnitZ(Factor=1)
concat = Concatenate(FragmentA="Time: ", FragmentB=read_results_3.time_dir)
Y_4 = UnitY(Factor=1)
Z_3 = UnitZ(Factor=1)
pl = ConstructPlane(Origin=pt_6, XAxis=Y_3, YAxis=Z_2)
Y_5 = UnitY(Factor=1)
Z_4 = UnitZ(Factor=1)
Y_6 = UnitY(Factor=1)
Z_5 = UnitZ(Factor=1)
tag = TextTag3D(
    Location=pl,
    Text=concat,
    Size=Slider(100, range=10..1000),
    Colour=ColourSwatch(SwatchColor=RGB(0, 0, 0)),
    Justification=7)

# ----
# K -> degree C
panel_14 = Panel("273.15")
subtraction = Subtraction(A=read_results_3.values, B=panel_14)

# ----
# volume fraction -> ppm
panel_15 = Panel("1000000")
multiplication = Multiplication(A=read_results_2.values, B=panel_15)

# ----
# Offset for display
number_slider_4 = Slider(40, range=0..1000)
Z_6 = UnitZ(Factor=number_slider_4)
move_5 = Move(Geometry=read_results_3.points, Motion=Z_6)  # -> Geometry, Transform

# ----
# Wind direction only,
# no scaling based on
# wind speed
number_slider_5 = Slider(50, range=10..1000)
unit = UnitVector(Vector=read_results.values)
multiplication_2 = Multiplication(A=unit, B=number_slider_5)

# ----
# Offset for display
number_slider_6 = Slider(0, range=0..1000)
Z_7 = UnitZ(Factor=number_slider_6)
move_6 = Move(Geometry=read_results.points, Motion=Z_7)  # -> Geometry, Transform

# ----
# Offset for display
number_slider_7 = Slider(20, range=0..1000)
Z_8 = UnitZ(Factor=number_slider_7)
move_7 = Move(Geometry=read_results_2.points, Motion=Z_8)  # -> Geometry, Transform

# ----
# velocity magnitude
vlen = VectorLength(Vector=read_results.values)

# ----
# unit
panel_16 = Panel(" degC")
concat_2 = Concatenate(FragmentA=subtraction, FragmentB=panel_16)

# ----
# unit
panel_17 = Panel(" m/s")
concat_3 = Concatenate(FragmentA=vlen, FragmentB=panel_17)

# ----
# unit
panel_18 = Panel(" ppm")
concat_4 = Concatenate(FragmentA=multiplication, FragmentB=panel_18)

pl_2 = ConstructPlane(Origin=move_5.Geometry, XAxis=Y_4, YAxis=Z_3)
vdisex = VectorDisplayEx(
    Point=read_results.points,
    Vector=multiplication_2,
    Colour=ColourSwatch(SwatchColor=RGB(161, 0, 0)),
    Width=Slider(1, range=1..20))
pl_3 = ConstructPlane(Origin=move_7.Geometry, XAxis=Y_5, YAxis=Z_4)
pl_4 = ConstructPlane(Origin=move_6.Geometry, XAxis=Y_6, YAxis=Z_5)
tag_2 = TextTag3D(
    Location=pl_2,
    Text=concat_2,
    Size=Slider(15, range=10..1000),
    Colour=ColourSwatch(SwatchColor=RGB(201, 0, 0)),
    Justification=7)
tag_3 = TextTag3D(
    Location=pl_3,
    Text=concat_4,
    Size=Slider(15, range=10..1000),
    Colour=ColourSwatch(SwatchColor=RGB(0, 18, 176)),
    Justification=7)
tag_4 = TextTag3D(
    Location=pl_4,
    Text=concat_3,
    Size=Slider(15, range=10..1000),
    Colour=ColourSwatch(SwatchColor=RGB(0, 147, 163)),
    Justification=7)

# ----
# Step 6: You may also display IAQ results as a heatmap
# Choose which data to display
# Note: here we use native Grasshopper components to display the legend.
# You may use other plugins to simplify the process.
# Min/Max, depending on standard (see IAQ report)
# Legend resolution
# Legend
carbonfly_iaq_standards = CarbonflyIAQStandards({"European standard CEN/EN 16798-1": "EN", "Japanese law for environmental health in buildings (LEHB)": "LEHB", "Singapore standard SS 554:2016": "SS", "Hong Kong Environmental Protection Department": "HK", "German environmental protection agency (Umweltbundesamt)": "UBA", "Department of Occupational Safety and Health (DOSH) Malaysia": "DOSH", "Brazilian standard ABNT NBR 16401-3:2008 and NBR 17037:2023": "NBR"}, selected="European standard CEN/EN 16798-1")
number_slider_8 = Slider(4, range=0..10)
co2_based_iaq = CO2BasedIAQ(CO2_indoor=multiplication, standard=carbonfly_iaq_standards)  # -> report, index; inputs CO2_indoor: list of Double, CO2_outdoor: list of Double, standard: String
#   port CO2_indoor: Indoor CO2 concentration (ppm)
#   port CO2_outdoor: Outdoor CO2 concentration (ppm); if empty, 400 ppm is used
#   port standard: CO2-based IAQ evaluation standard to apply: - European standard CEN/EN 16798-1 = "EN" - Japanese law for environmental health in buildings (LEHB) = "LEHB" - Singapore standard SS 554:2016 = "SS" - Hong Kong Environmental Protection Department = "HK" - German environmental protection agency (Umweltbundesamt) = "UBA" - Department of Occupational Safety and Health (DOSH) Malaysia = "DOSH" - Brazilian standard ABNT NBR 16401-3:2008 and NBR 17037:2023 = "NBR"
#   port index: The IAQ Index/Category. For description please see IAQ report
# ---------- co2_based_iaq: Python ----------
from carbonfly.iaq import iaq_co2

results = iaq_co2(
    co2_indoor = CO2_indoor,
    co2_outdoor = CO2_outdoor or 400,
    standard = standard or "EN"
)

reports = results[0]
index = results[1]

standard_name = reports["standard"]
co2_indoor = reports["co2_indoor"]
co2_outdoor = reports["co2_outdoor"]

if standard == "EN":
    description = (
        "Evaluation based on CO2 concentration differences between indoors and outdoors.\n"
        "- [Index = 1] Category I: ΔCO2 <= 550 ppm\n"
        "- [Index = 2] Category II: ΔCO2 <= 800 ppm\n"
        "- [Index = 3] Category III: ΔCO2 <= 1350 ppm\n"
        "- [Index = 4] Category IV: ΔCO2 > 1350 ppm"
    )
elif standard == "LEHB":
    description = (
        "Evaluation based on CO2 concentration indoors.\n"
        "- [Index = 1] Acceptable: CO2 <= 1000 ppm\n"
        "- [Index = 2] Unacceptable: CO2 > 1000 ppm"
    )
elif standard == "SS":
    description = (
        "Evaluation based on CO2 concentration differences between indoors and outdoors.\n"
        "- [Index = 1] Acceptable: ΔCO2 <= 700 ppm\n"
        "- [Index = 2] Unacceptable: ΔCO2 > 700 ppm"
    )
elif standard == "HK":
    description = (
        "Evaluation based on CO2 concentration indoors (averaging time 8-hour)."
        "Here the average is changed to an instantaneous evaluation for each measurment.\n"
        "- [Index = 1] Excellent Class: CO2 <= 800 ppm\n"
        "- [Index = 2] Good Class: CO2 <= 1000 ppm\n"
        "- [Index = 3] Unacceptable: CO2 > 1000 ppm"
    )
elif standard == "UBA":
    description = (
        "Evaluation based on CO2 concentration indoors.\n"
        "- [Index = 1] Hygienically safe: CO2 < 1000 ppm\n"
        "- [Index = 2] Hygienically conspicuous: CO2 <= 2000 ppm\n"
        "- [Index = 3] Hygienically unacceptable: CO2 > 2000 ppm"
    )
elif standard == "DOSH":
    description = (
        "Evaluation based on CO2 concentration indoors.\n"
        "- [Index = 1] Acceptable: CO2 <= 1000 ppm\n"
        "- [Index = 2] Unacceptable: CO2 > 1000 ppm"
    )
elif standard == "NBR":
    description = (
        "Evaluation based on CO2 concentration differences between indoors and outdoors.\n"
        "- [Index = 1] Acceptable: ΔCO2 <= 700 ppm\n"
        "- [Index = 2] Unacceptable: ΔCO2 > 700 ppm"
    )
else:
    description = "N/A"

report = (
    f"Standard: {standard_name}\n"
    f"CO2 indoor: {co2_indoor} ppm\n"
    f"CO2 outdoor: {co2_outdoor} ppm\n"
    f"Index: {index}\n"
    "\n"
    f"{description}"
)
# ---------- end co2_based_iaq ----------
data_to_display = Number(co2_based_iaq.index)
expression = Expression(x=number_slider_8, Expression="1/(x-1)")
dom = ConstructDomain(DomainStart=Slider(1, range=1..4), DomainEnd=Slider(5, range=0..5))
panel_19 = Panel(co2_based_iaq.report)
remap = RemapNumbers(Value=data_to_display, Source=dom, Target=Domain(0, 1))  # -> Mapped, Clipped
series = Series(Start=0, Step=expression, Count=number_slider_8)  # -> reverse(Series)
gradient = Gradient(LowerLimit=0, UpperLimit=1, Parameter=remap.Mapped, stops=[0: RGB(0, 128, 0), 0.5: RGB(255, 255, 0), 1: RGB(255, 0, 0)])
gradient_2 = Gradient(LowerLimit=0, UpperLimit=1, Parameter=series, stops=[0: RGB(0, 128, 0), 0.5: RGB(255, 255, 0), 1: RGB(255, 0, 0)])
legend_w = Slider(180, range=0..5000)
legend_h = Slider(1500, range=0..5000)
mcol = MeshColours(Mesh=mesh, Colours=gradient)
pt_7 = ConstructPoint(XCoordinate=Slider(3000, range=0..5000), YCoordinate=Slider(3460, range=0..5000), ZCoordinate=0)
Y_7 = UnitY(Factor=legend_w)
Z_9 = UnitZ(Factor=legend_h)
move_8 = Move(Geometry=pt_7, Motion=Y_7)  # -> Geometry, Transform
ln = Line(StartPoint=pt_7, EndPoint=move_8.Geometry)
extr_2 = Extrude(Base=ln, Direction=Z_9)
debrep_3 = DeconstructBrep(Brep=extr_2)  # -> Faces, Edges, Vertices
div = DivideDomain(Domain=dom, Count=number_slider_8)  # -> reverse(Segments)
item_8 = ListItem(List=debrep_3.Edges, Index=0, Wrap=True)
pi = Pi(Factor=1)
rotax = RotateAxis(Geometry=extr_2, Angle=pi, Axis=item_8)  # -> Geometry, Transform
legend = Legend(Colour=gradient_2, Tags=div, Rectangle=rotax.Geometry, LegendType=1)
preview_9 = CustomPreview(
    Geometry=mcol,
    Material={diffuse=RGB(221, 160, 221), emission=RGB(66, 48, 66), shine=0.5, specular=RGB(255, 255, 255), transparency=0})

# ----
# Step 5: Heatmap
# Choose which data to display
# Note: here we use native Grasshopper components to display the legend.
# You may use other plugins to simplify the process.
# Min/Max
# Legend resolution
# Legend
number_slider_9 = Slider(6, range=0..10)
data_to_display_2 = Number(multiplication)
expression_2 = Expression(x=number_slider_9, Expression="1/(x-1)")
dom_2 = ConstructDomain(DomainStart=Slider(400, range=0..2000), DomainEnd=Slider(1000, range=0..2000))
remap_2 = RemapNumbers(Value=data_to_display_2, Source=dom_2, Target=Domain(0, 1))  # -> Mapped, Clipped
series_2 = Series(Start=0, Step=expression_2, Count=number_slider_9)  # -> reverse(Series)
gradient_3 = Gradient(
    LowerLimit=0,
    UpperLimit=1,
    Parameter=remap_2.Mapped,
    stops=[0: RGB(48, 18, 59), 0.0294: RGB(56, 40, 112), 0.0588: RGB(63, 62, 156), 0.0882: RGB(68, 82, 193), 0.118: RGB(70, 102, 221), 0.147: RGB(71, 122, 241)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])
gradient_4 = Gradient(
    LowerLimit=0,
    UpperLimit=1,
    Parameter=series_2,
    stops=[0: RGB(48, 18, 59), 0.0294: RGB(56, 40, 112), 0.0588: RGB(63, 62, 156), 0.0882: RGB(68, 82, 193), 0.118: RGB(70, 102, 221), 0.147: RGB(71, 122, 241)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])
legend_w_2 = Slider(180, range=0..5000)
legend_h_2 = Slider(1500, range=0..5000)
mcol_2 = MeshColours(Mesh=mesh, Colours=gradient_3)
pt_8 = ConstructPoint(XCoordinate=Slider(3000, range=0..5000), YCoordinate=Slider(3250, range=0..5000), ZCoordinate=0)
Y_8 = UnitY(Factor=legend_w_2)
Z_10 = UnitZ(Factor=legend_h_2)
move_9 = Move(Geometry=pt_8, Motion=Y_8)  # -> Geometry, Transform
ln_2 = Line(StartPoint=pt_8, EndPoint=move_9.Geometry)
extr_3 = Extrude(Base=ln_2, Direction=Z_10)
debrep_4 = DeconstructBrep(Brep=extr_3)  # -> Faces, Edges, Vertices
div_2 = DivideDomain(Domain=dom_2, Count=number_slider_9)  # -> reverse(Segments)
item_9 = ListItem(List=debrep_4.Edges, Index=0, Wrap=True)
pi_2 = Pi(Factor=1)
rotax_2 = RotateAxis(Geometry=extr_3, Angle=pi_2, Axis=item_9)  # -> Geometry, Transform
legend_2 = Legend(Colour=gradient_4, Tags=div_2, Rectangle=rotax_2.Geometry, LegendType=101)
preview_10 = CustomPreview(
    Geometry=mcol_2,
    Material={diffuse=RGB(221, 160, 221), emission=RGB(66, 48, 66), shine=0.5, specular=RGB(255, 255, 255), transparency=0})
